# Grasshopper definition MP-PC-GAN Urban Form Optimizer.gh (Grasshopper 1.0.7)
# plug-ins: GH_CPython, LunchBox, Wallacei

panel = Panel("E:/aaa_Rhino_Optimization20250925/Sample_L/epoch.csv")
wlc_1 = GenePool(
    Decimals=0,
    Maximum=154,
    Minimum=0,
    Value=[69, 53, 130, 27, 18, 18, 117, 111, 76, 2, 115, 91, 79, 61, 15, 78, 136, 11, 98, 76, 82, 113, 41, 147, 71])
wlc_3 = GenePool(
    Decimals=2,
    Maximum=1,
    Minimum=0,
    Value=[0.72, 0.27, 0.65, 0.38, 0.62, 0.91, 0.59, 0.97, 0.52, 0.17, 0.15, 0.38, 0.78, 0.8, 0.27, 0.92, 0.02, 0.46, 0.07, 0.93, 0.97, 0.28, 0.75, 0.95, 0.38])
wlc_4 = GenePool(
    Decimals=2,
    Maximum=1,
    Minimum=0,
    Value=[0.56, 0.45, 0.49, 0.2, 0.93, 0.25, 0.2, 0.94, 0.01, 0.73, 0.19, 0.69, 0.09, 0.17, 0.37, 0.81, 0.17, 0.81, 0.73, 0.62, 0.86, 0.58, 0.64, 0.81, 0.15])
wlc_2 = GenePool(
    Decimals=2,
    Maximum=1,
    Minimum=0,
    Value=[0.28, 0.87, 0.85, 0.58, 0.39, 0.39, 0.86, 0.17, 0.97, 0.58, 0.85, 0.4, 0.39, 0.06, 0.54, 0.52, 0.37, 0.37, 0.1, 0.08, 0.89, 0.83, 0.96, 0.17, 0.4])

# ---- group: Road
import_3dm = Import3DM(File="E:/aaa_Rhino_Optimization20250925/Road_Reference/Road.3dm", Layer="*", Name="*")
mesh_edges_with_tolerance = MeshEdgesWithTolerance(Mesh=import_3dm, AngleThreshold=45)  # -> InteriorEdges, NakedEdges
unit_z = UnitZ(Factor=Slider(-0.3, range=-10..10))
boundary_surfaces = BoundarySurfaces(Edges=mesh_edges_with_tolerance.NakedEdges)
extrude = Extrude(Base=boundary_surfaces, Direction=unit_z)

# ----
plane_surface = PlaneSurface(Plane="0,0,-0.3", XSize="500", YSize="500")
unit_z_2 = UnitZ(Factor=Slider(-0.3, range=-10..10))
plane_surface_2 = PlaneSurface(Plane="0,0,1.6", XSize="500", YSize="500")  # -> flatten(Plane)

# ---- group: Analysis Size
gird_size = Slider(5, range=0..60)
genpts = LBGeneratePointGrid(geometry=plane_surface_2, grid_size=gird_size)  # -> points, vectors, face_areas, flatten(mesh); plug-in component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

# ----
extrude_2 = Extrude(Base=plane_surface, Direction=unit_z_2)  # -> flatten(Extrusion)
road_reference_path = Panel("E:/aaa_Rhino_Optimization20250925/Road_Reference/RoadRefencr.png")
cluster_summary_reference_path = Panel("E:/aaa_Rhino_Optimization20250925/Constraint/Building_C/cluster_summary.csv")
working_spaces = Panel("E:/aaa_Rhino_Optimization20250925/Sample_L/")
epoch_read = GH_CPython(
    Epoch_Reference_Path=panel,
    Scheme_Save_Path=working_spaces,
    Run_if=Toggle(True),
    data_A=wlc_1,
    data_B=wlc_2,
    data_C=wlc_3,
    data_D=wlc_4)  # -> value_v, Complete_information_output; inputs Epoch_Reference_Path: list, Scheme_Save_Path: list, Run_if: list, data_A: list, data_B: list, data_C: list, data_D: list
#   port value_v: indicate your output description here. refers to a new line.
# ---------- epoch_read: Python ----------
# -*- coding: utf-8 -*-
import pandas as pd
import numpy as np
import os



if Run_if == True:

    epoch = pd.read_csv(Epoch_Reference_Path,header=0)
    epoch = np.array(epoch)

    value_v = int(epoch)

    try:
        os.mkdir(Scheme_Save_Path+'/x0'+str(value_v)+'')

    except:
        print('yes')


    data_a = data_A
    data_a = np.array(data_a)
    np.save(''+str(Scheme_Save_Path)+'x0'+str(value_v)+'/data_a.npy',data_a)

    data_b = data_B
    data_b = np.array(data_b)
    np.save(''+str(Scheme_Save_Path)+'x0'+str(value_v)+'/data_b.npy',data_b)

    data_c = data_C
    data_c = np.array(data_c)
    np.save(''+str(Scheme_Save_Path)+'x0'+str(value_v)+'/data_c.npy',data_c)

    data_d = data_D
    data_d = np.array(data_d)
    np.save(''+str(Scheme_Save_Path)+'x0'+str(value_v)+'/data_d.npy',data_d)



    Complete_information_output = True
# ---------- end epoch_read ----------
boolean_toggle = BooleanToggle(True)
panel_2 = Panel(epoch_read.value_v)  # disabled
panel_3 = Panel(epoch_read.Complete_information_output)  # disabled
roomsolid = HBRoomFromSolid(geo=flatten(extrude_2), name="Impervious_a", conditioned=True)  # -> out, rooms; plug-in component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
panel_4 = Panel("Moist Soil")
sensorgrid = HBSensorGrid(positions=genpts.points, directions=genpts.vectors)  # -> grid; plug-in component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
processing_of_input_data = GH_CPython(
    input=epoch_read.Complete_information_output,
    Path=working_spaces,
    epoch_input=epoch_read.value_v,
    Building_Area_value=wlc_1,
    Building_number_value=wlc_2,
    Building_Volumn_value=wlc_3,
    Building_Green_value=wlc_4,
    If_Road_Reference=boolean_toggle,
    Road_reference_Path=road_reference_path,
    Cluster_summary_reference_Path=cluster_summary_reference_path)  # -> save_Path, Green_save_Path, Complete_information, epoch_output; inputs input: list, Path: list, epoch_input: list, Building_Area_value: list, Building_number_value: list, Building_Volumn_value: list, Building_Green_value: list, If_Road_Reference: list, Road_reference_Path: list, Cluster_summary_reference_Path: list
#   port input: [required] - [type = int] - [default = None] Descripe your input here * bullet point. * bullet point
#   port save_Path: indicate your output description here. refers to a new line.
# ---------- processing_of_input_data: Python ----------
# -*- coding: utf-8 -*-


import pandas as pd
import numpy as np
import tensorflow as tf
import torch
from PIL import Image


Constrain = pd.read_csv(Cluster_summary_reference_Path,header=0)

'''定义数据加载'''
def MatrixCompletion(original_array,down_Value,Left_Value):
    # 扩展行和列
    # 原始数组（假设为25x25x1）
    array_2d = original_array.squeeze()  # 去除单通道维度，变为25x25

    # 扩展行和列
    expanded_rows = np.repeat(array_2d, 50, axis=0)  # 行重复10次 → 250x25
    expanded_cols = np.repeat(expanded_rows, 50, axis=1)  # 列重复10次 → 250x250

    # 左侧和下侧补充白边，用于CycleGAN的镜像识别
    padded_array = np.pad(
        expanded_cols,
        pad_width=((0, 6), (6, 0)),  # 行方向：下侧补6行；列方向：左侧补6列
        mode="constant",
        constant_values=((down_Value,5) # 行方向：上侧补0，下侧补5
                        ,(Left_Value,0) # 列方向：左侧补0，右侧不补（值0不影响）
                        ))
    
    return padded_array


def Constrain_Generate_N(a_value,Building_number_value):
    match_data = Constrain[(Constrain['A_min'] <= a_value) &  (Constrain['A_max'] >= a_value)]

    intervals = list(zip(match_data['D_min'], match_data['D_max']))
    # 按区间起始值排序
    intervals.sort(key=lambda x: x[0])

    # 合并重叠或连续区间
    merged = []
    for start, end in intervals:
        if not merged:
            merged.append((start, end))
        else:
            last_start, last_end = merged[-1]
            if start <= last_end + 1:
                # 有重叠或连续，合并区间
                merged[-1] = (last_start, max(last_end, end))
            else:
                merged.append((start, end))

    intervals = []
    # 输出最终结果

    for start, end in merged:
        intervals.append([start,end])

    intervals_result = np.unique(np.concatenate([np.arange(start, end + 1) for start, end in intervals])) #合并区间
    n = len(intervals_result)

    index = Building_number_value * (n - 1)  
    Build_N_Val = intervals_result[int(index)] 

    return Build_N_Val
 

def Constrain_Generate_V(a_value,b_value,Building_Volumn_value):

    match_data = Constrain[(Constrain['A_min'] <= a_value) &  (Constrain['A_max'] >= a_value) & (Constrain['D_min'] <= b_value) & (Constrain['D_max'] >= b_value)]

    intervals = list(zip(match_data['V_min'], match_data['V_max']))
    # 按区间起始值排序
    intervals.sort(key=lambda x: x[0])
    # 合并重叠或连续区间
    merged = []
    for start, end in intervals:
        if not merged:
            merged.append((start, end))
        else:
            last_start, last_end = merged[-1]
            if start <= last_end + 1:
                # 有重叠或连续，合并区间
                merged[-1] = (last_start, max(last_end, end))
            else:
                merged.append((start, end))

    intervals = []
    # 输出最终结果

    for start, end in merged:
        intervals.append([start,end])

    intervals_result = np.unique(np.concatenate([np.arange(start, end + 1) for start, end in intervals])) #合并区间
    n = len(intervals_result)

    index = Building_Volumn_value * (n - 1)  
    Build_V_Val = intervals_result[int(index)] 

    return Build_V_Val


def Constrain_Generate_GreenValue(a_value,b_value,c_value,Building_Green_value):
    match_data = Constrain[(Constrain['A_min'] <= a_value) &  (Constrain['A_max'] >= a_value) & (Constrain['D_min'] <= b_value) & (Constrain['D_max'] >= b_value) & (Constrain['V_min'] <= c_value) & (Constrain['V_max'] >= c_value)]
    intervals = list(zip(match_data['G_min'], match_data['G_max']))
    # 按区间起始值排序
    intervals.sort(key=lambda x: x[0])

    # 合并重叠或连续区间
    merged = []
    for start, end in intervals:
        if not merged:
            merged.append((start, end))
        else:
            last_start, last_end = merged[-1]
            if start <= last_end + 1:
                # 有重叠或连续，合并区间
                merged[-1] = (last_start, max(last_end, end))
            else:
                merged.append((start, end))

    intervals = []
    # 输出最终结果

    for start, end in merged:
        intervals.append([start,end])

    intervals_result = np.unique(np.concatenate([np.arange(start, end + 1) for start, end in intervals])) #合并区间
    n = len(intervals_result)

    index = Building_Green_value * (n - 1)  
    Green_Val = intervals_result[int(index)] 

    return Green_Val




epoch = epoch_input

if _input == True:



    A_Array = []
    N_Array = []
    V_Array = []
    G_Array = []

    for i in range(0,25):
        Build_A_Val = Building_Area_value[i]
        A_Array.append(Build_A_Val)

        Build_N_Val = Constrain_Generate_N(Build_A_Val,Building_number_value[i])
        N_Array.append(Build_N_Val)

        Build_V_Val = Constrain_Generate_V(Build_A_Val, Build_N_Val, Building_Volumn_value[i])
        V_Array.append(Build_V_Val)

        Green_Val = Constrain_Generate_GreenValue(Build_A_Val,Build_N_Val,Build_V_Val,Building_Green_value[i])
        G_Array.append(Green_Val)

    A_Array = np.array(A_Array)
    N_Array = np.array(N_Array)
    V_Array = np.array(V_Array)
    G_Array = np.array(G_Array)

    A_Array = A_Array.reshape(5,5)
    N_Array = N_Array.reshape(5,5)
    V_Array = V_Array.reshape(5,5)
    G_Array = G_Array.reshape(5,5)


    R_Value = MatrixCompletion(A_Array,0,255)
    G_Value = MatrixCompletion(V_Array,255,255)
    B_Value = MatrixCompletion(N_Array,255,255)

    Green_value = MatrixCompletion(G_Array,0,0)
    # print(R_Value.shape)


    combined_array = np.stack([R_Value, G_Value, B_Value], axis=2)



    if If_Road_Reference == True:


        #Road_reference_Path = 'i:/aaa_Rhino_Optimization/Road_Reference/RoadRefencr.png'
        RoadReference = Image.open(Road_reference_Path) #转为图片格式
        RoadReference = RoadReference.convert("RGB")
        # print(type(RoadReference))
        RoadReference = np.array(RoadReference) 

        '''创建Road的Mask'''
        Road_mask = (RoadReference[:, :, 0] == 0) & (RoadReference[:, :, 1] == 255) & (RoadReference[:, :, 2] == 255)

        combined_array[Road_mask] = [0, 255, 255]



    Green_V_array = np.stack([Green_value, Green_value, Green_value], axis=2) 
    # print(combined_array.shape)

    real_image = (combined_array / 127.5) - 1
    # plt.imshow(real_image)

    # 转换为 TensorFlow EagerTensor，并指定 dtype=float32
    tensor = tf.convert_to_tensor(real_image, dtype=tf.float32)

    Green_Tensor = Image.fromarray(np.uint8(Green_V_array)) #转图像

    # 添加一个批次维度（从 (256,256,3) 变为 (1,256,256,3)）
    tensor = tf.expand_dims(tensor, axis=0)

    BuildingTensor = tensor
    # BuildingTensor = BuildingTensor.numpy()
    # BuildingTensor = BuildingTensor.reshape(-1,1)
    # BuildingTensor = BuildingTensor.tolist()
    #
    # GreenValue = Green_value

    # output_ = BuildingTensor
    # print(BuildingTensor)

    # 保存到文件
    torch.save(BuildingTensor, ''+str(Path)+'x0'+str(epoch)+'/tensor.pt')  # 扩展名通常为.pt或.pt
    Green_Tensor.save(''+str(Path)+'x0'+str(epoch)+'/Green_Tensor.png')

    save_Path = ''+str(Path)+'x0'+str(epoch)+'/tensor.pt'
    Green_save_Path = ''+str(Path)+'x0'+str(epoch)+'/Green_Tensor.png'


    import gc
    gc.collect()  # 强制回收循环引用对象[9](@ref)

    Complete_information = True

    epoch_output = epoch
# ---------- end processing_of_input_data ----------
ground = HBGround(rooms=roomsolid.rooms, soil_constr="Concrete Pavement")  # -> rooms; plug-in component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

roomsolid_2 = HBRoomFromSolid(geo=flatten(extrude), name="road_a", conditioned=True)  # -> out, rooms; plug-in component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
panel_5 = Panel("Solid Rock")
ground_2 = HBGround(rooms=roomsolid_2.rooms, soil_constr="Asphalt Pavement")  # -> rooms; plug-in component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

intervals_trees = Panel("10")
panel_6 = Panel(processing_of_input_data.save_Path)  # disabled
panel_7 = Panel(processing_of_input_data.Complete_information)  # disabled
panel_8 = Panel(processing_of_input_data.Green_save_Path)  # disabled
pix_model_path_reference = Panel("E:/aaa_Rhino_Optimization20250925/GeneModel/Building_PixModel/")
cyc_model_path_reference = Panel("E:/aaa_Rhino_Optimization20250925/GeneModel/Building_CycModel/")
cyclegan_data_path_reference = Panel("E:/aaa_Rhino_Optimization20250925/GeneModel/CycleGAN_DATA")

# ---- group: Generate architectural design proposal
pc_gan_model_for_building = GH_CPython(
    Path=working_spaces,
    input=processing_of_input_data.Complete_information,
    Tensor_path=processing_of_input_data.save_Path,
    epoch=processing_of_input_data.epoch_output,
    Pix_Model_Path_Reference=pix_model_path_reference,
    Cyc_Model_Path_Reference=cyc_model_path_reference,
    CycleGAN_DATA_Path_Reference=cyclegan_data_path_reference)  # -> save_Path, Complete_information, epoch_output; inputs Path: list, input: list, Tensor_path: list, epoch: list, Pix_Model_Path_Reference: list, Cyc_Model_Path_Reference: list, CycleGAN_DATA_Path_Reference: list
#   port input: [required] - [type = int] - [default = None] Descripe your input here * bullet point. * bullet point
#   port save_Path: indicate your output description here. refers to a new line.
# ---------- pc_gan_model_for_building: Python ----------
# -*- coding: utf-8 -*-
import torch
print(torch.__version__)
print(torch.cuda.is_available())


# This Python 3 environment comes with many helpful analytics libraries installed
# It is defined by the kaggle/python docker image: https://github.com/kaggle/docker-python
# For example, here's several helpful packages to load in

import numpy as np # linear algebra
import pandas as pd # data processing, CSV file I/O (e.g. pd.read_csv)
import torch
import torch.nn as nn
import torch.nn.functional as F
import torch.optim as optim
from torch.autograd import Variable
import torch.utils.data as data
import random
from torchvision import transforms
import torchvision.models.vgg as vgg
import torch.utils.model_zoo as model_zoo
from collections import namedtuple
import torch
from PIL import Image

import os , itertools

import matplotlib.pyplot as plt

print(torch.cuda.is_available())

'''加载模型'''
import sys
print(sys.executable)
import tensorflow as tf
print(tf.test.is_gpu_available())
import os
import time
import keras
from PIL import Image
from matplotlib import pyplot as plt
from IPython import display
from IPython.display import clear_output
import os
os.environ['KMP_DUPLICATE_LIB_OK']='True'
import numpy as np
import pandas as pd

tf.config.experimental.reset_memory_stats('GPU:0')

import gc
gc.collect()


if _input == True:
    
    # 从文件加载
    #Tensor = torch.load('I:\\1207Optimation_UICI\\20250429Rhino_Optimization\\Sample\\1\\tensor.pt', weights_only=False)
    Tensor = torch.load(Tensor_path, weights_only=False)
    
    '''Pix2'''
    
    '''输入的参数'''
    # The facade training set consist of 400 images
    BUFFER_SIZE = 400
    # The batch size of 1 produced better results for the U-Net in the original pix2pix experiment
    BATCH_SIZE = 1
    # Each image is 256x256 in size
    IMG_WIDTH = 256
    IMG_HEIGHT = 256
    
    
    def load(image_file):
        image = tf.io.read_file(image_file)
        image = tf.image.decode_jpeg(image)
    
        w = tf.shape(image)[1]
    
        w = w // 2
        input_image = image[:, :w, :]
        real_image = image[:, w:, :]
    
        input_image = tf.cast(input_image, tf.float32)
        real_image = tf.cast(real_image, tf.float32)
    
        return input_image, real_image
    
    
    def resize(input_image, real_image, height, width):
        input_image = tf.image.resize(input_image, [height, width],
                                      method=tf.image.ResizeMethod.NEAREST_NEIGHBOR)
        real_image = tf.image.resize(real_image, [height, width],
                                     method=tf.image.ResizeMethod.NEAREST_NEIGHBOR)
    
        return input_image, real_image
    
    
    def random_crop(input_image, real_image):
        stacked_image = tf.stack([input_image, real_image], axis=0)
        cropped_image = tf.image.random_crop(
            stacked_image, size=[2, IMG_HEIGHT, IMG_WIDTH, 3])
    
        return cropped_image[0], cropped_image[1]
    
    
    # normalizing the images to [-1, 1]
    def normalize(input_image, real_image):
        input_image = (input_image / 127.5) - 1
        real_image = (real_image / 127.5) - 1
    
        return input_image, real_image
    
    
    @tf.function()
    def random_jitter(input_image, real_image):
        # resizing to 286 x 286 x 3
        input_image, real_image = resize(input_image, real_image, 286, 286)
    
        # randomly cropping to 256 x 256 x 3
        input_image, real_image = random_crop(input_image, real_image)
    
        if tf.random.uniform(()) > 0.5:
            # random mirroring
            input_image = tf.image.flip_left_right(input_image)
            real_image = tf.image.flip_left_right(real_image)
    
        return input_image, real_image
    
    
    def load_image_train(image_file):
        input_image, real_image = load(image_file)
        input_image, real_image = random_jitter(input_image, real_image)
        input_image, real_image = normalize(input_image, real_image)
    
        return input_image, real_image
    
    
    def load_image_test(image_file):
        input_image, real_image = load(image_file)
        input_image, real_image = resize(input_image, real_image,
                                         IMG_HEIGHT, IMG_WIDTH)
        input_image, real_image = normalize(input_image, real_image)
    
        return input_image, real_image
    
    
    '''加载 Train & Test 数据集'''
    # train_dataset = tf.data.Dataset.list_files(PATH+'*.png')
    # train_dataset = train_dataset.map(load_image_train,
    #                                   num_parallel_calls=tf.data.experimental.AUTOTUNE)
    # train_dataset = train_dataset.shuffle(BUFFER_SIZE)
    # train_dataset = train_dataset.batch(BATCH_SIZE)
    
    # test_dataset = tf.data.Dataset.list_files(PATH+'*.png',seed=42, shuffle=False) # 改
    # test_dataset = test_dataset.map(load_image_test)
    # test_dataset = test_dataset.batch(BATCH_SIZE)
    
    
    OUTPUT_CHANNELS = 3
    
    
    def downsample(filters, size, apply_batchnorm=True):
        initializer = tf.random_normal_initializer(0., 0.02)
    
        result = tf.keras.Sequential()
        result.add(
            tf.keras.layers.Conv2D(filters, size, strides=2, padding='same',
                                   kernel_initializer=initializer, use_bias=False))
    
        if apply_batchnorm:
            result.add(tf.keras.layers.BatchNormalization())
    
        result.add(tf.keras.layers.LeakyReLU())
    
        return result
    
    
    def upsample(filters, size, apply_dropout=False):
        initializer = tf.random_normal_initializer(0., 0.02)
    
        result = tf.keras.Sequential()
        result.add(
            tf.keras.layers.Conv2DTranspose(filters, size, strides=2,
                                            padding='same',
                                            kernel_initializer=initializer,
                                            use_bias=False))
    
        result.add(tf.keras.layers.BatchNormalization())
    
        if apply_dropout:
            result.add(tf.keras.layers.Dropout(0.5))
    
        result.add(tf.keras.layers.ReLU())
    
        return result
    
    
    def Generator():
        inputs = tf.keras.layers.Input(shape=[256, 256, 3])
    
        down_stack = [
            downsample(64, 4, apply_batchnorm=False),  # (bs, 128, 128, 64)
            downsample(128, 4),  # (bs, 64, 64, 128)
            downsample(256, 4),  # (bs, 32, 32, 256)
            downsample(512, 4),  # (bs, 16, 16, 512)
            downsample(512, 4),  # (bs, 8, 8, 512)
            downsample(512, 4),  # (bs, 4, 4, 512)
            downsample(512, 4),  # (bs, 2, 2, 512)
            downsample(512, 4),  # (bs, 1, 1, 512)
        ]
    
        up_stack = [
            upsample(512, 4, apply_dropout=True),  # (bs, 2, 2, 1024)
            upsample(512, 4, apply_dropout=True),  # (bs, 4, 4, 1024)
            upsample(512, 4, apply_dropout=True),  # (bs, 8, 8, 1024)
            upsample(512, 4),  # (bs, 16, 16, 1024)
            upsample(256, 4),  # (bs, 32, 32, 512)
            upsample(128, 4),  # (bs, 64, 64, 256)
            upsample(64, 4),  # (bs, 128, 128, 128)
        ]
    
        initializer = tf.random_normal_initializer(0., 0.02)
        last = tf.keras.layers.Conv2DTranspose(OUTPUT_CHANNELS, 4,
                                               strides=2,
                                               padding='same',
                                               kernel_initializer=initializer,
                                               activation='tanh')  # (bs, 256, 256, 3)
    
        x = inputs
    
        # Downsampling through the model
        skips = []
        for down in down_stack:
            x = down(x)
            skips.append(x)
    
        skips = reversed(skips[:-1])
    
        # Upsampling and establishing the skip connections
        for up, skip in zip(up_stack, skips):
            x = up(x)
            x = tf.keras.layers.Concatenate()([x, skip])
    
        x = last(x)
    
        return tf.keras.Model(inputs=inputs, outputs=x)
    
    
    LAMBDA = 100
    
    loss_object = tf.keras.losses.BinaryCrossentropy(from_logits=True)
    
    
    def generator_loss(disc_generated_output, gen_output, target):
        gan_loss = loss_object(tf.ones_like(disc_generated_output), disc_generated_output)
    
        # mean absolute error
        l1_loss = tf.reduce_mean(tf.abs(target - gen_output))
    
        total_gen_loss = gan_loss + (LAMBDA * l1_loss)
    
        return total_gen_loss, gan_loss, l1_loss
    
    
    def Discriminator():
        initializer = tf.random_normal_initializer(0., 0.02)
    
        inp = tf.keras.layers.Input(shape=[256, 256, 3], name='input_image')
        tar = tf.keras.layers.Input(shape=[256, 256, 3], name='target_image')
    
        x = tf.keras.layers.concatenate([inp, tar])  # (bs, 256, 256, channels*2)
    
        down1 = downsample(64, 4, False)(x)  # (bs, 128, 128, 64)
        down2 = downsample(128, 4)(down1)  # (bs, 64, 64, 128)
        down3 = downsample(256, 4)(down2)  # (bs, 32, 32, 256)
    
        zero_pad1 = tf.keras.layers.ZeroPadding2D()(down3)  # (bs, 34, 34, 256)
        conv = tf.keras.layers.Conv2D(512, 4, strides=1,
                                      kernel_initializer=initializer,
                                      use_bias=False)(zero_pad1)  # (bs, 31, 31, 512)
    
        batchnorm1 = tf.keras.layers.BatchNormalization()(conv)
        leaky_relu = tf.keras.layers.LeakyReLU()(batchnorm1)
        zero_pad2 = tf.keras.layers.ZeroPadding2D()(leaky_relu)  # (bs, 33, 33, 512)
        last = tf.keras.layers.Conv2D(1, 4, strides=1,
                                      kernel_initializer=initializer)(zero_pad2)  # (bs, 30, 30, 1)
    
        return tf.keras.Model(inputs=[inp, tar], outputs=last)
    
    
    def discriminator_loss(disc_real_output, disc_generated_output):
        real_loss = loss_object(tf.ones_like(disc_real_output), disc_real_output)
    
        generated_loss = loss_object(tf.zeros_like(disc_generated_output), disc_generated_output)
    
        total_disc_loss = real_loss + generated_loss
    
        return total_disc_loss
    
    
    # 初始化持续退火学习率策略
    class ExponentialDecayLearningRate:
        def __init__(self, initial_learning_rate, decay_rate, decay_steps):
            self.initial_learning_rate = initial_learning_rate
            self.decay_rate = decay_rate
            self.decay_steps = decay_steps
    
        def __call__(self, step):
            return self.initial_learning_rate * (self.decay_rate ** (step / self.decay_steps))
    
    
    generator_optimizer = tf.keras.optimizers.Adam(
        learning_rate=38.5e-5,  # 20250217
        beta_1=0.5,
        beta_2=0.999,
        epsilon=1e-07, decay=0.00001,
        amsgrad=False,
        # weight_decay=0.0,
        clipnorm=None,
        clipvalue=None,
        global_clipnorm=None,
        # use_ema=False,
        # ema_momentum=0.99,
        # ema_overwrite_frequency=None,
        # jit_compile=True,
    )
    
    discriminator_optimizer = tf.keras.optimizers.Adam(
        learning_rate=27.8e-5,  # 20250224
    
        beta_1=0.5,
        beta_2=0.999,
        epsilon=1e-07, decay=0.000075,
        amsgrad=False,
        # weight_decay=0.0,
        clipnorm=None,
        clipvalue=None,
        global_clipnorm=None,
        # use_ema=False,
        # ema_momentum=0.99,
        # ema_overwrite_frequency=None,
        # jit_compile=True,
    )
    
    # 初始化持续退火学习率策略
    lr_schedule_g = ExponentialDecayLearningRate(initial_learning_rate=7.5e-5, decay_steps=25, decay_rate=0.94)
    lr_schedule_d = ExponentialDecayLearningRate(initial_learning_rate=4e-5, decay_steps=25, decay_rate=0.92)
    
    generator = Generator()
    discriminator = Discriminator()
    
    checkpoint_dir = Pix_Model_Path_Reference
    checkpoint_prefix = os.path.join(checkpoint_dir, "ckpt")
    checkpoint = tf.train.Checkpoint(generator_optimizer=generator_optimizer,
                                     discriminator_optimizer=discriminator_optimizer,
                                     generator=generator,
                                     discriminator=discriminator)
    
    '''定义图片生成'''
    
    
    def generate_images(model, test_input, ):
        prediction = model(test_input, training=True)
    
        img_tensor = (prediction * 0.5 + 0.5) * 255
        print(img_tensor.shape)
        img_tensor = tf.cast(img_tensor, tf.uint8)
    
        print(img_tensor.shape)
    
        # 1. 移除批次维度
        img_tensor = tf.squeeze(img_tensor, axis=0)  # shape=(256, 256, 3)
    
        print(img_tensor.shape)
        plt.imshow(img_tensor)
        # 2. 编码并保存
        # encoded_png = tf.image.encode_png(img_tensor)
        # print(encoded_png.shape)
    
        return img_tensor
    
    
    '''加载需要的模型'''
    # restoring the latest checkpoint in checkpoint_dir
    # checkpoint.restore(tf.train.latest_checkpoint(checkpoint_dir))
    checkpoint.restore(tf.train.latest_checkpoint(Pix_Model_Path_Reference)).expect_partial()
    
    
    Output = generate_images(generator, Tensor)
    
    '''调整Tensor，输入CycleGAN'''
    input_size = 256
    
    transform = transforms.Compose([
        transforms.Resize(size=input_size),
        transforms.ToTensor(),
        transforms.Normalize(mean=(0.5, 0.5, 0.5), std=(0.5, 0.5, 0.5))
    ])
    
    def DatasetLoadCycleGAN(img,resize_scale=None,crop_size=None,fliplr=None,transform=None):
        img = Output.numpy().astype(np.uint8)
        img = Image.fromarray(img)
        img = img.convert('RGB')
    
        # preprocessing
        if resize_scale is not None:
            img = img.resize((resize_scale, resize_scale), Image.BILINEAR)
    
        if crop_size is not None:
            x = random.randint(0, resize_scale - crop_size + 1)
            y = random.randint(0, resize_scale - crop_size + 1)
            img = img.crop((x, y, x + crop_size, y + crop_size))
        if fliplr is not None:
            if random.random() < 0.5:
                img = img.transpose(Image.FLIP_LEFT_RIGHT)
    
        if transform is not None:
            img = transform(img)
    
        return img
    
    CycleGANInput = DatasetLoadCycleGAN(Output,resize_scale=None,crop_size=None,fliplr=None,transform=transform)
    CycleGANInput_new_tensor = torch.reshape(CycleGANInput, (1, 3, 256, 256))
    
    
    
    #model params
    params = {
        'batch_size':1,
        'input_size':256,
        'resize_scale':257,
        'crop_size':256,
        'fliplr':True,
        'num_epochs':350,
        'decay_epoch':250,
        'ngf':32,   #number of generator filters
        'ndf':64,   #number of discriminator filters
        'num_resnet':6, #number of resnet blocks
        'lrG':1.6e-05,    #learning rate for generator
        'lrD':1.6e-05,    #learning rate for discriminator
        'beta1':0.5 ,    #beta1 for Adam optimizer
        'beta2':0.999 ,  #beta2 for Adam optimizer
        'lambdaA':10 ,   #lambdaA for cycle loss
        'lambdaB':10  ,  #lambdaB for cycle loss
    }
    
    data_dir = CycleGAN_DATA_Path_Reference
    
    def to_np(x):
        return x.data.cpu().numpy()
    def plot_train_result(real_image, gen_image, recon_image, iii, epoch, save=False,  show=True, fig_size=(15, 15)):
        fig, axes = plt.subplots(2, 3, figsize=fig_size)
        imgs = [to_np(real_image[0]), to_np(gen_image[0]), to_np(recon_image[0]),
                to_np(real_image[1]), to_np(gen_image[1]), to_np(recon_image[1])]
        for ax, img in zip(axes.flatten(), imgs):
            ax.axis('off')
            #ax.set_adjustable('box-forced')
            # Scale to 0-255
            img = img.squeeze()
            img = (((img - img.min()) * 255) / (img.max() - img.min())).transpose(1, 2, 0).astype(np.uint8)
            ax.imshow(img, cmap=None, aspect='equal')
        plt.subplots_adjust(wspace=0, hspace=0)
    
        title = 'Epoch {0}'.format(epoch + 1)
        fig.text(0.5, 0.04, title, ha='center')
    
    
    class ImagePool():
        def __init__(self, pool_size):
            self.pool_size = pool_size
            if self.pool_size > 0:
                self.num_imgs = 0
                self.images = []
    
        def query(self, images):
            if self.pool_size == 0:
                return images
            return_images = []
            for image in images.data:
                image = torch.unsqueeze(image, 0)
                if self.num_imgs < self.pool_size:
                    self.num_imgs = self.num_imgs + 1
                    self.images.append(image)
                    return_images.append(image)
                else:
                    p = random.uniform(0, 1)
                    if p > 0.5:
                        random_id = random.randint(0, self.pool_size-1)
                        tmp = self.images[random_id].clone()
                        self.images[random_id] = image
                        return_images.append(tmp)
                    else:
                        return_images.append(image)
            return_images = Variable(torch.cat(return_images, 0))
            return return_images
    
    class DatasetFromFolder(data.Dataset):
        def __init__(self, image_dir, subfolder='train', transform=None, resize_scale=None, crop_size=None, fliplr=False):
            super(DatasetFromFolder, self).__init__()
            self.input_path = os.path.join(image_dir, subfolder)
            self.image_filenames = [x for x in sorted(os.listdir(self.input_path))]
            self.transform = transform
    
            self.resize_scale = resize_scale
            self.crop_size = crop_size
            self.fliplr = fliplr
    
        def __getitem__(self, index):
            # Load Image
            img_fn = os.path.join(self.input_path, self.image_filenames[index])
            img = Image.open(img_fn).convert('RGB')
    
            # preprocessing
            if self.resize_scale:
                img = img.resize((self.resize_scale, self.resize_scale), Image.BILINEAR)
    
            if self.crop_size:
                x = random.randint(0, self.resize_scale - self.crop_size + 1)
                y = random.randint(0, self.resize_scale - self.crop_size + 1)
                img = img.crop((x, y, x + self.crop_size, y + self.crop_size))
            if self.fliplr:
                if random.random() < 0.5:
                    img = img.transpose(Image.FLIP_LEFT_RIGHT)
    
            if self.transform is not None:
                img = self.transform(img)
    
            return img
    
        def __len__(self):
            return len(self.image_filenames)
    
    
    #https://github.com/aitorzip/PyTorch-CycleGAN/blob/master/models.py
    class ResidualBlock(nn.Module):
        def __init__(self, in_features):
            super(ResidualBlock, self).__init__()
    
            conv_block = [  nn.ReflectionPad2d(1),
                            nn.Conv2d(in_features, in_features, 3),
                            nn.InstanceNorm2d(in_features),
                            nn.ReLU(inplace=True),
                            nn.ReflectionPad2d(1),
                            nn.Conv2d(in_features, in_features, 3),
                            nn.InstanceNorm2d(in_features)  ]
    
            self.conv_block = nn.Sequential(*conv_block)
    
        def forward(self, x):
            return x + self.conv_block(x)
    
    class Generator(nn.Module):
        def __init__(self, input_nc, output_nc, n_residual_blocks=9):
            super(Generator, self).__init__()
    
            # Initial convolution block
            model = [   nn.ReflectionPad2d(3),
                        nn.Conv2d(input_nc, 64, 7),
                        nn.InstanceNorm2d(64),
                        nn.ReLU(inplace=True) ]
    
            # Downsampling
            in_features = 64
            out_features = in_features*2
            for _ in range(2):
                model += [  nn.Conv2d(in_features, out_features, 3, stride=2, padding=1),
                            nn.InstanceNorm2d(out_features),
                            nn.ReLU(inplace=True) ]
                in_features = out_features
                out_features = in_features*2
    
            # Residual blocks
            for _ in range(n_residual_blocks):
                model += [ResidualBlock(in_features)]
    
            # Upsampling
            out_features = in_features//2
            for _ in range(2):
                model += [  nn.ConvTranspose2d(in_features, out_features, 3, stride=2, padding=1, output_padding=1),
                            nn.InstanceNorm2d(out_features),
                            nn.ReLU(inplace=True) ]
                in_features = out_features
                out_features = in_features//2
    
            # Output layer
            model += [  nn.ReflectionPad2d(3),
                        nn.Conv2d(64, output_nc, 7),
                        nn.Tanh() ]
    
            self.model = nn.Sequential(*model)
    
        def forward(self, x):
            return self.model(x)
    
    class Discriminator(nn.Module):
        def __init__(self, input_nc):
            super(Discriminator, self).__init__()
    
            # A bunch of convolutions one after another
            model = [   nn.Conv2d(input_nc, 64, 4, stride=2, padding=1),
                        nn.LeakyReLU(0.2, inplace=True) ]
    
            model += [  nn.Conv2d(64, 128, 4, stride=2, padding=1),
                        nn.InstanceNorm2d(128),
                        nn.LeakyReLU(0.2, inplace=True) ]
    
            model += [  nn.Conv2d(128, 256, 4, stride=2, padding=1),
                        nn.InstanceNorm2d(256),
                        nn.LeakyReLU(0.2, inplace=True) ]
    
            model += [  nn.Conv2d(256, 512, 4, padding=1),
                        nn.InstanceNorm2d(512),
                        nn.LeakyReLU(0.2, inplace=True) ]
    
            # FCN classification layer
            model += [nn.Conv2d(512, 1, 4, padding=1)]
    
            self.model = nn.Sequential(*model)
    
        def forward(self, x):
            x =  self.model(x)
            # Average pooling and flatten
            return F.avg_pool2d(x, x.size()[2:]).view(x.size()[0], -1)
    
    transform = transforms.Compose([
        transforms.Resize(size=params['input_size']),
        transforms.ToTensor(),
        transforms.Normalize(mean=(0.5, 0.5, 0.5), std=(0.5, 0.5, 0.5))
    ])
    #Subfolders - day & night
    train_data_A = DatasetFromFolder(data_dir, subfolder='TrainCUT', transform=transform,
                                    resize_scale=params['resize_scale'], crop_size=params['crop_size'], fliplr=params['fliplr'])
    train_data_loader_A = torch.utils.data.DataLoader(dataset=train_data_A, batch_size=params['batch_size'], shuffle=False)
    train_data_B = DatasetFromFolder(data_dir, subfolder='TureCUT', transform=transform,
                                    resize_scale=params['resize_scale'], crop_size=params['crop_size'], fliplr=params['fliplr'])
    train_data_loader_B = torch.utils.data.DataLoader(dataset=train_data_B, batch_size=params['batch_size'], shuffle=False)
    
    #Kaggle GPU
    device = torch.device("cuda:0" if torch.cuda.is_available() else "cpu")
    
    
    def weights_init_normal(m):
        classname = m.__class__.__name__
        if classname.find('Conv') != -1:
            torch.nn.init.normal_(m.weight.data, 0.0, 0.02)
        elif classname.find('BatchNorm2d') != -1:
            torch.nn.init.normal_(m.weight.data, 1.0, 0.02)
            torch.nn.init.constant_(m.bias.data, 0.0)
    
    #Build Model
    #G_A - Day->Night ; G_B - Night -> Day
    G_A = Generator(3,3).cuda()
    G_B = Generator(3,3).cuda()
    
    #two Discriminators
    D_A = Discriminator(3).cuda()
    D_B = Discriminator(3).cuda()
    
    G_A.apply(weights_init_normal)
    G_B.apply(weights_init_normal)
    D_A.apply(weights_init_normal)
    D_B.apply(weights_init_normal)
    
    
    G_optimizer = torch.optim.Adam(itertools.chain(G_A.parameters(), G_B.parameters()), lr=params['lrG'], betas=(params['beta1'], params['beta2']))
    D_A_optimizer = torch.optim.Adam(D_A.parameters(), lr=params['lrD'], betas=(params['beta1'], params['beta2']))
    D_B_optimizer = torch.optim.Adam(D_B.parameters(), lr=params['lrD'], betas=(params['beta1'], params['beta2']))
    
    MSE_Loss = torch.nn.MSELoss().cuda()
    L1_Loss = torch.nn.L1Loss().cuda()
    LossOutput = namedtuple("LossOutput", ["relu1_2", "relu2_2", "relu3_3", "relu4_3"])
    
    # https://discuss.pytorch.org/t/how-to-extract-features-of-an-image-from-a-trained-model/119/3
    class LossNetwork(torch.nn.Module):
        def __init__(self, vgg_model):
            super(LossNetwork, self).__init__()
            self.vgg_layers = vgg_model.features
            self.layer_name_mapping = {
                '3': "relu1_2",
                '8': "relu2_2",
                '15': "relu3_3",
                '22': "relu4_3"
            }
    
        def forward(self, x):
            output = {}
            for name, module in self.vgg_layers._modules.items():
                x = module(x)
                if name in self.layer_name_mapping:
                    output[self.layer_name_mapping[name]] = x
            return LossOutput(**output)
    
    vgg_model = vgg.vgg16(pretrained=True)
    if torch.cuda.is_available():
        vgg_model.cuda()
    loss_network = LossNetwork(vgg_model)
    loss_network.eval()
    del vgg_model
    
    def gram_matrix(y):
        (b, ch, h, w) = y.size()
        features = y.view(b, ch, w * h)
        features_t = features.transpose(1, 2)
        gram = features.bmm(features_t) / (ch * h * w)
        return gram
    
    def compStyle(a,b):
        #http://pytorch.org/docs/master/notes/autograd.html#volatile
        styleB_loss_features = loss_network(Variable(a, volatile=True))
        gram_style = [Variable(gram_matrix(y).data, requires_grad=False) for y in styleB_loss_features]
    
        features_y = loss_network(b)
    
        style_loss = 0
        for m in range(len(features_y)):
            gram_s = gram_style[m]
            gram_y = gram_matrix(features_y[m])
            style_loss += 1e4 * MSE_Loss(gram_y, gram_s.expand_as(gram_y))
        return style_loss
    
    
    
    save_dir = Cyc_Model_Path_Reference  # 例如："./checkpoints/"
    
    # 为每个模型定义要加载的checkpoint路径
    load_path_G_A = os.path.join(save_dir, "G_A_epoch_122.pth")
    # load_path_G_B = os.path.join(save_dir, "G_B_epoch_100.pth")
    # load_path_D_A = os.path.join(save_dir, "D_A_epoch_"+str(iii)+".pth")
    # load_path_D_B = os.path.join(save_dir, "D_B_epoch_"+str(iii)+".pth")
    
    # 加载每个模型的权重
    G_A.load_state_dict(torch.load(load_path_G_A))
    # G_B.load_state_dict(torch.load(load_path_G_B))
    # D_A.load_state_dict(torch.load(load_path_D_A))
    # D_B.load_state_dict(torch.load(load_path_D_B))
    
    count = 0
    
    real_A = CycleGANInput_new_tensor.to(device)
    
    print(type(real_A))
    # print(real_A)
    # print(real_A.shape)
    
    
    fake_B = G_A(real_A)
    
    
    img = fake_B
    img = img.squeeze()
    img = to_np(img) #将张量转化为numpy
    
    img = (((img - img.min()) * 255) / (img.max() - img.min())).transpose(1, 2, 0).astype(np.uint8) #转化为255
    

    # 清空PyTorch的CUDA缓存
    torch.cuda.empty_cache()  # 释放未使用的显存[9,10](@ref)

    # 删除不再使用的大对象
    del G_A, fake_B, real_A


    '''像素矫正'''
    img_pil = Image.fromarray(img)  # 转换为 PIL Image 对象
    img_rgb = img_pil.convert("RGB")  # 转换为 RGB 模式
    
    # 获取像素点数据
    pixels = img_rgb.load()
    width, height = img_rgb.size  # 获取图片的尺寸
    
    '''特定地表类型二值转化&像素矫正'''
    data_re = []
    
    error = 28
    
    data_re = []
    for x in range(width):
        for y in range(height):
            r, g, b = pixels[x, y]
    
            if (255 - error) <= r <= (255 + error) and (250 - error) <= g <= (250 + error) and (255 - error) <= b <= (
                    255 + error):
                data_re.append([255, 250, 255])
    
            elif (10 - error) <= r <= (10 + error) and (230 - error) <= g <= (230 + error) and (255 - error) <= b <= (
                    255 + error):
                data_re.append([10, 230, 255])
    
            elif (15 - error) <= r <= (15 + error) and (15 - error) <= g <= (15 + error) and (15 - error) <= b <= (
                    15 + error):
                data_re.append([15, 15, 15])
    
            elif (245 - error) <= r <= (245 + error) and (1 - error) <= b <= (1 + error):
                data_re.append([245, g, 1])
    
            else:
                data_re.append([r, g, b])
    
    '''包装Nparray'''
    data_re = np.array(data_re)
    data_re = data_re.reshape(256, 256, 3)
    data_re = Image.fromarray(np.uint8(data_re))
    data_re = data_re.convert("RGB")
    data_re = data_re.rotate(90)  # 逆时针旋转90
    data_re = data_re.transpose(Image.FLIP_TOP_BOTTOM)  # 垂直翻转
    
    data_re = np.uint8(data_re)  # 格式转化为uint8
    
    '''像素去噪'''
    import cv2
    import numpy as np
    
    '''设置消除单元大小'''
    Size_Delet= (3,3)
    
    
    # 假设 data_re 是 RGB 三通道的 uint8 数组，形状为 (256, 256, 3)
    # 定义颜色范围（根据实际颜色调整 lower 和 upper）
    lower = np.array([240, 0, 0])    # 颜色下限 [R_min, G_min, B_min]
    upper = np.array([245, 255, 5])    # 颜色上限 [R_max, G_max, B_max]
    
    # 生成颜色掩膜（二值图像）
    mask = cv2.inRange(data_re, lower, upper)
    
    # 增加边框（避免边界效应）
    MakeBorder = 4
    mask = cv2.copyMakeBorder(mask, MakeBorder, MakeBorder, MakeBorder, MakeBorder,
                              cv2.BORDER_CONSTANT, value=0)
    
    # 形态学开运算：腐蚀去除小噪点 + 膨胀恢复斑块
    kernel = np.ones(Size_Delet, np.uint8)  # 核大小根据噪点大小调整
    iterations = 1                      # 迭代次数
    eroded = cv2.erode(mask, kernel, iterations=iterations)
    dilated = cv2.dilate(eroded, kernel, iterations=iterations)
    
    # 裁剪掉增加的边框
    processed_mask = dilated[MakeBorder:-MakeBorder, MakeBorder:-MakeBorder]
    
    # 用掩膜提取原图中的目标斑块（消除噪点后）
    result = cv2.bitwise_and(data_re, data_re, mask=processed_mask)
    
    Result_Building = Image.fromarray(np.uint8(result)) #转为图片格式
    Result_Building = Result_Building.convert("RGB") #转为RGB
    
    # epoch = 1
    #Path = 'I:\\1207Optimation_UICI\\20250429Rhino_Optimization\\Sample\\'
    
    Result_Building.save(''+str(Path)+'x0'+str(epoch)+'/sample.png')
    Result_Building.close()  # 显式关闭图像资源
    
    save_Path = ''+str(Path)+'x0'+str(epoch)+'/sample.png'

    import gc
    gc.collect()

    Complete_information = True

    epoch_output = epoch
# ---------- end pc_gan_model_for_building ----------
image_crop = GH_CPython(
    input=pc_gan_model_for_building.Complete_information,
    Path=working_spaces,
    save_Path=pc_gan_model_for_building.save_Path,
    epoch=pc_gan_model_for_building.epoch_output)  # -> save_Path, Complete_information, epoch_output; inputs input: list, Path: list, save_Path: list, epoch: list
#   port save_Path: [required] - [type = int] - [default = None] Descripe your input here * bullet point. * bullet point
# ---------- image_crop: Python ----------
# -*- coding: utf-8 -*-
from PIL import Image
import matplotlib.pyplot as plt
import numpy as np
import gc

if _input == True:
        
    
    img_1 = Image.open(save_Path)
    img_1 = img_1.convert("RGB")
    # 设置裁剪的位置
    crop_box = (6,0,256,250)
    # 裁剪图片
    img_2 = img_1.crop(crop_box)
    img_2 = img_2.convert("RGB")

    # img_2 = np.array(img_2)
    # print(img_2.shape)
    # epoch = 1


    img_2.save(''+str(Path)+'x0'+str(epoch)+'/sampleCut.png')


    gc.collect()

    '''output'''
    save_Path = ''+str(Path)+'x0'+str(epoch)+'/sampleCut.png'


    # 显式释放资源
    del img_1, img_2
    gc.collect()


    Complete_information = True

    epoch_output = epoch
# ---------- end image_crop ----------
panel_9 = Panel(pc_gan_model_for_building.save_Path)  # disabled
panel_10 = Panel(pc_gan_model_for_building.Complete_information)  # disabled
panel_11 = Panel(pc_gan_model_for_building.epoch_output)  # disabled
panel_12 = Panel(image_crop.save_Path)  # disabled
panel_13 = Panel(image_crop.epoch_output)  # disabled
panel_14 = Panel(image_crop.Complete_information)  # disabled

# ----
# 下限
# 上限
intervals_trees_2 = Panel("30")

green_pix_model_reference_path = Panel("E:/aaa_Rhino_Optimization20250925/GeneModel/Green_PixModel")
pc_gan_for_greenarea = GH_CPython(
    input=image_crop.Complete_information,
    save_Path=pc_gan_model_for_building.save_Path,
    Green_save_path=processing_of_input_data.Green_save_Path,
    Path=working_spaces,
    epoch=image_crop.epoch_output,
    If_Road_Reference=boolean_toggle,
    Road_reference_Path=road_reference_path,
    Green_Pix_Model_reference_Path=green_pix_model_reference_path)  # -> green_save_Path, Complete_information, epoch_output, a; inputs input: list, save_Path: list, Green_save_path: list, Path: list, epoch: list, If_Road_Reference: list, Road_reference_Path: list, Green_Pix_Model_reference_Path: list
#   port save_Path: [required] - [type = int] - [default = None] Descripe your input here * bullet point. * bullet point
#   port green_save_Path: indicate your output description here. refers to a new line.
# ---------- pc_gan_for_greenarea: Python ----------
# -*- coding: utf-8 -*-

import torch
print(torch.__version__)
print(torch.cuda.is_available())


# This Python 3 environment comes with many helpful analytics libraries installed
# It is defined by the kaggle/python docker image: https://github.com/kaggle/docker-python
# For example, here's several helpful packages to load in

import numpy as np # linear algebra
import pandas as pd # data processing, CSV file I/O (e.g. pd.read_csv)
import torch
import torch.nn as nn
import torch.nn.functional as F
import torch.optim as optim
from torch.autograd import Variable
import torch.utils.data as data
import random
from torchvision import transforms
import torchvision.models.vgg as vgg
import torch.utils.model_zoo as model_zoo
from collections import namedtuple
import torch
from PIL import Image

import os , itertools

import matplotlib.pyplot as plt

print(torch.cuda.is_available())

'''加载模型'''
import sys
print(sys.executable)
import tensorflow as tf
print(tf.test.is_gpu_available())
import os
import time
import keras
from PIL import Image
from matplotlib import pyplot as plt
from IPython import display
from IPython.display import clear_output
import os
os.environ['KMP_DUPLICATE_LIB_OK']='True'
import numpy as np
import pandas as pd

tf.config.experimental.reset_memory_stats('GPU:0')

import gc
gc.collect()



error = 18


#save_Path = 'i:/aaa_Rhino_Optimization/Sample/x01/sample.png'
#Green_save_path = 'i:/aaa_Rhino_Optimization/Sample/x01/Green_Tensor.png'

if _input == True:

    Result_Building = Image.open(save_Path) #转为图片格式
    Result_Building = Result_Building.convert("RGB") #转为RGB


    if If_Road_Reference == True:


        RoadReference = Image.open(Road_reference_Path) #转为图片格式
        RoadReference = RoadReference.convert("RGB")
        # print(type(RoadReference))
        RoadReference = np.array(RoadReference) 

        '''创建Road的Mask'''
        Road_mask = (RoadReference[:, :, 0] == 0) & (RoadReference[:, :, 1] == 255) & (RoadReference[:, :, 2] == 255)

        Result_Building = np.array(Result_Building)
        Result_Building[Road_mask] = [255, 250, 255]
        Result_Building = Image.fromarray(np.uint8(Result_Building)) #转为图片格式
        Result_Building = Result_Building.convert("RGB") #转为RGB


    '''加载GreenValue'''
    Green_input_sample = Image.open(Green_save_path) #转图像
    Green_input_sample = Green_input_sample.convert("RGB")


    # 获取像素点数据
    Building_pixels = Result_Building.load()

    Green_pixels = Green_input_sample.load()

    '''获取图片的尺寸'''
    width, height = Result_Building.size 

    '''重建Data'''
    data_re_Green = []
    for x in range(width):
        for y in range(height):

            r, g, b = Building_pixels[x, y]
            r_G, g_G, b_G = Green_pixels[x, y]


             #建筑
            if (245-error)<= r <= (245+error)  and  b <=(1+error):
                data_re_Green.append([150, g, b_G]) #像素矫正

            #道路
            elif (255-error)<= r <= (255+error)  and  (250-error)<= g <= (250+error) and (255-error)<= b <= (255+error) :
                data_re_Green.append([255, 250, 255]) #像素矫正

            #水体
            elif (10-error)<= r <= (10+error)  and  (230-error)<= g <= (230+error) and (255-error)<= b <= (255+error) :
                data_re_Green.append([255, 150, 255]) #像素矫正

            else:
                data_re_Green.append([15, 15, b_G]) #像素矫正




    '''结束循环，数据保存'''
    data_re_Green = np.array(data_re_Green)
    data_re_Green = data_re_Green.reshape(256,256,3)
    print(data_re_Green.shape)

    data_re_Green = Image.fromarray(np.uint8(data_re_Green))
    data_re_Green = data_re_Green.convert("RGB") 
    data_re_Green = data_re_Green.rotate(90) # 逆时针旋转90
    data_re_Green = data_re_Green.transpose(Image.FLIP_TOP_BOTTOM) #垂直翻转





    '''生成绿地'''
    '''输入的参数'''
    # The facade training set consist of 400 images
    BUFFER_SIZE = 400
    # The batch size of 1 produced better results for the U-Net in the original pix2pix experiment
    BATCH_SIZE = 1
    # Each image is 256x256 in size
    IMG_WIDTH = 256
    IMG_HEIGHT = 256


    def load(image_file):
      image = tf.io.read_file(image_file)
      image = tf.image.decode_jpeg(image)

      w = tf.shape(image)[1]

      w = w // 2
      input_image = image[:, :w, :]
      real_image= image[:, w:, :]

      input_image = tf.cast(input_image, tf.float32)
      real_image = tf.cast(real_image, tf.float32)

      return input_image, real_image

    def resize(input_image, real_image, height, width):
      input_image = tf.image.resize(input_image, [height, width],
                                    method=tf.image.ResizeMethod.NEAREST_NEIGHBOR)
      real_image = tf.image.resize(real_image, [height, width],
                                   method=tf.image.ResizeMethod.NEAREST_NEIGHBOR)

      return input_image, real_image

    def random_crop(input_image, real_image):
      stacked_image = tf.stack([input_image, real_image], axis=0)
      cropped_image = tf.image.random_crop(
          stacked_image, size=[2, IMG_HEIGHT, IMG_WIDTH, 3])

      return cropped_image[0], cropped_image[1]

    # normalizing the images to [-1, 1]
    def normalize(input_image, real_image):
      input_image = (input_image / 127.5) - 1
      real_image = (real_image / 127.5) - 1

      return input_image, real_image

    @tf.function()
    def random_jitter(input_image, real_image):
      # resizing to 286 x 286 x 3
      input_image, real_image = resize(input_image, real_image, 286, 286)

      # randomly cropping to 256 x 256 x 3
      input_image, real_image = random_crop(input_image, real_image)

      if tf.random.uniform(()) > 0.5:
        # random mirroring
        input_image = tf.image.flip_left_right(input_image)
        real_image = tf.image.flip_left_right(real_image)

      return input_image, real_image


    def load_image_train(image_file):
      input_image, real_image = load(image_file)
      input_image, real_image = random_jitter(input_image, real_image)
      input_image, real_image = normalize(input_image, real_image)

      return input_image, real_image

    def load_image_test(image_file):
      input_image, real_image = load(image_file)
      input_image, real_image = resize(input_image, real_image,
                                       IMG_HEIGHT, IMG_WIDTH)
      input_image, real_image = normalize(input_image, real_image)

      return input_image, real_image


    '''加载 Train & Test 数据集'''
    # train_dataset = tf.data.Dataset.list_files(PATH+'*.png')
    # train_dataset = train_dataset.map(load_image_train,
    #                                   num_parallel_calls=tf.data.experimental.AUTOTUNE)
    # train_dataset = train_dataset.shuffle(BUFFER_SIZE)
    # train_dataset = train_dataset.batch(BATCH_SIZE)

    # test_dataset = tf.data.Dataset.list_files(PATH+'*.png',seed=42, shuffle=False) # 改
    # test_dataset = test_dataset.map(load_image_test)
    # test_dataset = test_dataset.batch(BATCH_SIZE)


    OUTPUT_CHANNELS = 3

    def downsample(filters, size, apply_batchnorm=True):
      initializer = tf.random_normal_initializer(0., 0.02)

      result = tf.keras.Sequential()
      result.add(
          tf.keras.layers.Conv2D(filters, size, strides=2, padding='same',
                                 kernel_initializer=initializer, use_bias=False))

      if apply_batchnorm:
        result.add(tf.keras.layers.BatchNormalization())

      result.add(tf.keras.layers.LeakyReLU())

      return result

    def upsample(filters, size, apply_dropout=False):
      initializer = tf.random_normal_initializer(0., 0.02)

      result = tf.keras.Sequential()
      result.add(
        tf.keras.layers.Conv2DTranspose(filters, size, strides=2,
                                        padding='same',
                                        kernel_initializer=initializer,
                                        use_bias=False))

      result.add(tf.keras.layers.BatchNormalization())

      if apply_dropout:
          result.add(tf.keras.layers.Dropout(0.5))

      result.add(tf.keras.layers.ReLU())

      return result

    def Generator():
      inputs = tf.keras.layers.Input(shape=[256, 256, 3])

      down_stack = [
        downsample(64, 4, apply_batchnorm=False),  # (bs, 128, 128, 64)
        downsample(128, 4),  # (bs, 64, 64, 128)
        downsample(256, 4),  # (bs, 32, 32, 256)
        downsample(512, 4),  # (bs, 16, 16, 512)
        downsample(512, 4),  # (bs, 8, 8, 512)
        downsample(512, 4),  # (bs, 4, 4, 512)
        downsample(512, 4),  # (bs, 2, 2, 512)
        downsample(512, 4),  # (bs, 1, 1, 512)
      ]

      up_stack = [
        upsample(512, 4, apply_dropout=True),  # (bs, 2, 2, 1024)
        upsample(512, 4, apply_dropout=True),  # (bs, 4, 4, 1024)
        upsample(512, 4, apply_dropout=True),  # (bs, 8, 8, 1024)
        upsample(512, 4),  # (bs, 16, 16, 1024)
        upsample(256, 4),  # (bs, 32, 32, 512)
        upsample(128, 4),  # (bs, 64, 64, 256)
        upsample(64, 4),  # (bs, 128, 128, 128)
      ]

      initializer = tf.random_normal_initializer(0., 0.02)
      last = tf.keras.layers.Conv2DTranspose(OUTPUT_CHANNELS, 4,
                                             strides=2,
                                             padding='same',
                                             kernel_initializer=initializer,
                                             activation='tanh')  # (bs, 256, 256, 3)

      x = inputs

      # Downsampling through the model
      skips = []
      for down in down_stack:
        x = down(x)
        skips.append(x)

      skips = reversed(skips[:-1])

      # Upsampling and establishing the skip connections
      for up, skip in zip(up_stack, skips):
        x = up(x)
        x = tf.keras.layers.Concatenate()([x, skip])

      x = last(x)

      return tf.keras.Model(inputs=inputs, outputs=x)

    LAMBDA = 100

    loss_object = tf.keras.losses.BinaryCrossentropy(from_logits=True)


    def generator_loss(disc_generated_output, gen_output, target):
      gan_loss = loss_object(tf.ones_like(disc_generated_output), disc_generated_output)

      # mean absolute error
      l1_loss = tf.reduce_mean(tf.abs(target - gen_output))

      total_gen_loss = gan_loss + (LAMBDA * l1_loss)

      return total_gen_loss, gan_loss, l1_loss


    def Discriminator():
      initializer = tf.random_normal_initializer(0., 0.02)

      inp = tf.keras.layers.Input(shape=[256, 256, 3], name='input_image')
      tar = tf.keras.layers.Input(shape=[256, 256, 3], name='target_image')

      x = tf.keras.layers.concatenate([inp, tar])  # (bs, 256, 256, channels*2)

      down1 = downsample(64, 4, False)(x)  # (bs, 128, 128, 64)
      down2 = downsample(128, 4)(down1)  # (bs, 64, 64, 128)
      down3 = downsample(256, 4)(down2)  # (bs, 32, 32, 256)

      zero_pad1 = tf.keras.layers.ZeroPadding2D()(down3)  # (bs, 34, 34, 256)
      conv = tf.keras.layers.Conv2D(512, 4, strides=1,
                                    kernel_initializer=initializer,
                                    use_bias=False)(zero_pad1)  # (bs, 31, 31, 512)

      batchnorm1 = tf.keras.layers.BatchNormalization()(conv)
      leaky_relu = tf.keras.layers.LeakyReLU()(batchnorm1)
      zero_pad2 = tf.keras.layers.ZeroPadding2D()(leaky_relu)  # (bs, 33, 33, 512)
      last = tf.keras.layers.Conv2D(1, 4, strides=1,
                                    kernel_initializer=initializer)(zero_pad2)  # (bs, 30, 30, 1)

      return tf.keras.Model(inputs=[inp, tar], outputs=last)


    def discriminator_loss(disc_real_output, disc_generated_output):
      real_loss = loss_object(tf.ones_like(disc_real_output), disc_real_output)

      generated_loss = loss_object(tf.zeros_like(disc_generated_output), disc_generated_output)

      total_disc_loss = real_loss + generated_loss

      return total_disc_loss

    # 初始化持续退火学习率策略
    class ExponentialDecayLearningRate:
        def __init__(self, initial_learning_rate, decay_rate, decay_steps):
            self.initial_learning_rate = initial_learning_rate
            self.decay_rate = decay_rate
            self.decay_steps = decay_steps

        def __call__(self, step):
            return self.initial_learning_rate * (self.decay_rate ** (step / self.decay_steps))
        

    generator_optimizer = tf.keras.optimizers.Adam(
    learning_rate=38.5e-5, #20250217
    beta_1=0.5,
    beta_2=0.999,
    epsilon=1e-07, decay= 0.00001,
    amsgrad=False,
    # weight_decay=0.0,
    clipnorm=None,
    clipvalue=None,
    global_clipnorm=None,
    # use_ema=False,
    # ema_momentum=0.99,
    # ema_overwrite_frequency=None,
    # jit_compile=True,
    )


    discriminator_optimizer = tf.keras.optimizers.Adam(
    learning_rate=27.8e-5, #20250224

    beta_1=0.5,
    beta_2=0.999,
    epsilon=1e-07, decay= 0.000075,
    amsgrad=False,
    # weight_decay=0.0,
    clipnorm=None,
    clipvalue=None,
    global_clipnorm=None,
    # use_ema=False,
    # ema_momentum=0.99,
    # ema_overwrite_frequency=None,
    # jit_compile=True,
    )

    # 初始化持续退火学习率策略
    lr_schedule_g = ExponentialDecayLearningRate(initial_learning_rate=7.5e-5, decay_steps=25, decay_rate=0.94)
    lr_schedule_d = ExponentialDecayLearningRate(initial_learning_rate=4e-5, decay_steps=25, decay_rate=0.92)


    generator_Green = Generator()
    discriminator_Green = Discriminator()

    # checkpoint_dir = 'i:\\1207Optimation_UICI\\20250314Pix2pix\\'
    # checkpoint_prefix = os.path.join(checkpoint_dir, "ckpt")
    checkpoint_Green = tf.train.Checkpoint(generator_optimizer=generator_optimizer,
                                     discriminator_optimizer=discriminator_optimizer,
                                     generator=generator_Green,
                                     discriminator=discriminator_Green)




    '''定义图片生成'''
    def generate_Green_images(model, test_input, ):
      prediction = model(test_input, training=True)

      img_tensor = (prediction * 0.5 + 0.5) * 255 
      print(img_tensor.shape)
      img_tensor = tf.cast(img_tensor, tf.uint8) 

      print(img_tensor.shape)

      # 1. 移除批次维度
      img_tensor = tf.squeeze(img_tensor, axis=0)  # shape=(256, 256, 3)

      print(img_tensor.shape)
      plt.imshow(img_tensor)
      # 2. 编码并保存
      # encoded_png = tf.image.encode_png(img_tensor)
      # print(encoded_png.shape)

      return img_tensor


    '''加载需要的模型'''
    # restoring the latest checkpoint in checkpoint_dir
    # checkpoint.restore(tf.train.latest_checkpoint(checkpoint_dir))
    # checkpoint_Green.restore(tf.train.latest_checkpoint('i:/aaa_Rhino_Optimization/GeneModel/Green_PixModel/'))
    checkpoint_Green.restore(tf.train.latest_checkpoint(Green_Pix_Model_reference_Path))





    data_re_Green = np.array(data_re_Green)

    Input_Green_Image = (data_re_Green / 127.5) - 1
    plt.imshow(Input_Green_Image)

    # 转换为 TensorFlow EagerTensor，并指定 dtype=float32
    tensor_Green = tf.convert_to_tensor(Input_Green_Image, dtype=tf.float32)

    # 添加一个批次维度（从 (256,256,3) 变为 (1,256,256,3)）
    tensor_Green = tf.expand_dims(tensor_Green, axis=0)

    Output_Green = generate_Green_images(generator_Green, tensor_Green)


    numpy_array = Output_Green.numpy()

    img_pil = Image.fromarray(numpy_array)  # 转换为 PIL Image 对象
    img_rgb = img_pil.convert("RGB")  # 转换为 RGB 模式

    # 获取像素点数据
    pixels = img_rgb.load()
    width, height = img_rgb.size #获取图片的尺寸


    '''特定地表类型二值转化&像素矫正'''
    data_re = []

    error = 38

    data_re = []
    for x in range(width):
        for y in range(height):
            r, g, b = pixels[x, y]


            if (255-error)<= r <=(255+error)  and  (250-error)<= g <= (250+error) and  (255-error)<= b <= (255+error):
                data_re.append([255,250,255])

            elif (10-error)<= r <=(10+error)  and  (230-error)<= g <= (230+error) and  (255-error)<= b <= (255+error):
                data_re.append([10,230,255])
            
            elif (15-error)<= r <=(15+error)  and  (15-error)<= g <= (15+error) and  (15-error)<= b <= (15+error):
                data_re.append([15,15,15])

            elif (245-error)<= r <=(245+error)   and  (1-error)<= b <= (1+error):
                data_re.append([245,g,1])

            elif (60-error)<= r <=(60+error)   and  (170-error)<= g <= (170+error) and  (10-error)<= b <= (10+error):
                data_re.append([60,170,10])

            elif (170-error)<= r <=(170+error)   and  (255-error)<= g <= (255+error) and  (10-error)<= b <= (10+error):
                data_re.append([170,255,10])

            else:
                data_re.append([r,g,b])

    '''包装Nparray'''
    data_re = np.array(data_re)
    data_re = data_re.reshape(256,256,3)
    data_re = Image.fromarray(np.uint8(data_re))
    data_re = data_re.convert("RGB") 
    data_re = data_re.rotate(90) # 逆时针旋转90
    data_re = data_re.transpose(Image.FLIP_TOP_BOTTOM) #垂直翻转

    data_re = np.uint8(data_re) #格式转化为uint8


    Result_Building = Image.fromarray(np.uint8(data_re)) #转为图片格式
    Result_Building = Result_Building.convert("RGB") #转为RGB

    # epoch = 1
    #Path = 'I:\\1207Optimation_UICI\\20250429Rhino_Optimization\\Sample\\'

    Result_Building.save(''+str(Path)+'x0'+str(epoch)+'/Green_sample.png')

    green_save_Path = ''+str(Path)+'x0'+str(epoch)+'/Green_sample.png'


    import gc
    gc.collect()

    Complete_information = True

    epoch_output = epoch
# ---------- end pc_gan_for_greenarea ----------
image_crop_for_greenarea = GH_CPython(
    input=pc_gan_for_greenarea.Complete_information,
    Path=working_spaces,
    save_Path=pc_gan_for_greenarea.green_save_Path,
    epoch=pc_gan_for_greenarea.epoch_output)  # -> save_Path, Complete_information, epoch_output; inputs input: list, Path: list, save_Path: list, epoch: list
#   port save_Path: [required] - [type = int] - [default = None] Descripe your input here * bullet point. * bullet point
# ---------- image_crop_for_greenarea: Python ----------
# -*- coding: utf-8 -*-
from PIL import Image
import matplotlib.pyplot as plt
import numpy as np
import gc

if _input == True:
        
    
    img_1 = Image.open(save_Path)
    img_1 = img_1.convert("RGB")
    # 设置裁剪的位置
    crop_box = (6,0,256,250)
    # 裁剪图片
    img_2 = img_1.crop(crop_box)
    img_2 = img_2.convert("RGB")

    # img_2 = np.array(img_2)
    # print(img_2.shape)
    # epoch = 1

    img_2.save(''+str(Path)+'x0'+str(epoch)+'/Green_sampleCut.png')

    '''output'''
    save_Path = ''+str(Path)+'x0'+str(epoch)+'/Green_sampleCut.png'


    del img_1, img_2
    gc.collect()

    Complete_information = True

    epoch_output = epoch
# ---------- end image_crop_for_greenarea ----------
panel_15 = Panel(pc_gan_for_greenarea.green_save_Path)  # disabled
panel_16 = Panel(pc_gan_for_greenarea.Complete_information)  # disabled
panel_17 = Panel(pc_gan_for_greenarea.epoch_output)  # disabled
panel_18 = Panel(image_crop_for_greenarea.save_Path)  # disabled
panel_19 = Panel(image_crop_for_greenarea.Complete_information)  # disabled
panel_20 = Panel(image_crop_for_greenarea.epoch_output)  # disabled

gh_cpython = GH_CPython(
    Run_if=image_crop_for_greenarea.Complete_information,
    SampleCUT_Path=image_crop.save_Path,
    Scheme_Save_Path=working_spaces,
    value_v=epoch_read.value_v)  # -> Build_polygons_Path_2m, Complete_information; inputs Run_if: list, SampleCUT_Path: list, Scheme_Save_Path: list, value_v: list
#   port SampleCUT_Path: [required] - [type = int] - [default = None] Descripe your input here * bullet point. * bullet point
#   port Build_polygons_Path_2m: indicate your output description here. refers to a new line.
# ---------- gh_cpython: Python ----------
# -*- coding: utf-8 -*-
# -*- coding: utf-8 -*-
import gc
import os
import numpy as np
import geopandas as gpd
import pyproj
from skimage.measure import label, regionprops
from shapely.geometry import Polygon
from PIL import Image
from pyproj import CRS
print(pyproj.datadir.get_data_dir())  # 打印当前PROJ路径
import matplotlib.pyplot as plt

import os
import pyproj
from pyproj import CRS


if Run_if==True:

    proj_db_path = r"d:/software/python310/lib/site-packages/pyproj/proj_dir/share/proj"
    # 1. 设置PROJ数据库路径（关键修复！）
    os.environ['PROJ_LIB'] = proj_db_path  # 关键设置！
    pyproj.datadir.set_data_dir(proj_db_path)  # 显式指定路径

    # 步骤3：验证路径
    print("当前PROJ路径:", pyproj.datadir.get_data_dir())  # 检查是否生效
    print("proj.db是否存在:", os.path.exists(os.path.join(proj_db_path, "proj.db")))  # 确认文件存在


    # 手动定义UTM Zone 50N坐标系（EPSG:32650的WKT）
    crs_wkt = """
    PROJCS["WGS 84 / UTM zone 50N",
        GEOGCS["WGS 84",
            DATUM["WGS_1984",
                SPHEROID["WGS 84",6378137,298.257223563,
                    AUTHORITY["EPSG","7030"]],
                AUTHORITY["EPSG","6326"]],
            PRIMEM["Greenwich",0,
                AUTHORITY["EPSG","8901"]],
            UNIT["degree",0.0174532925199433,
                AUTHORITY["EPSG","9122"]],
            AUTHORITY["EPSG","4326"]],
        PROJECTION["Transverse_Mercator"],
        PARAMETER["latitude_of_origin",0],
        PARAMETER["central_meridian",117],
        PARAMETER["scale_factor",0.9996],
        PARAMETER["false_easting",500000],
        PARAMETER["false_northing",0],
        UNIT["metre",1,
            AUTHORITY["EPSG","9001"]],
        AXIS["Easting",EAST],
        AXIS["Northing",NORTH],
        AUTHORITY["EPSG","32650"]]
    """


    '''读取图片'''
    srcPath_input = SampleCUT_Path
    # 读取图像并转为数组
    # 2. 读取图像
    img = Image.open(srcPath_input)
    image = np.array(img)
    img.close()  # 显式关闭


    # 创建建筑掩膜：R=245, B=1
    building_mask = (image[:, :, 0] == 245) & (image[:, :, 2] == 1)
    # 连通域标记（8邻域）
    labeled_mask = label(building_mask, connectivity=2)


    # 遍历每个连通域（建筑）
    for region in regionprops(labeled_mask):
        # 获取当前建筑的像素坐标
        coords = region.coords
        
        # 提取原始G值（高度值）
        g_values = image[coords[:, 0], coords[:, 1], 1]
        
        # 计算平均高度
        avg_height = int(np.mean(g_values))
        # if avg_height<3:
        #     avg_height == 3
        
        # 更新G通道
        image[coords[:, 0], coords[:, 1], 1] = avg_height



    '''将不透水的值转化为0'''
    impervious_mask = (image[:, :, 0] == 15) & (image[:, :, 1] == 15) & (image[:, :, 2] == 15)
    image[impervious_mask] = [0, 0, 0]  # 直接修改原数组


    '''大于80m的值全部转化为80'''
    # 分离通道（R, G, B）
    r, g, b = image[:, :, 0], image[:, :, 1], image[:, :, 2]

    # 修改G通道：大于80的值设为80
    g[g > 80] = 80  # 直接通过数组掩码操作[9](@ref)

    # 重组RGB并保存
    image = np.stack([r, g, b], axis=2)



    import numpy as np
    import rasterio
    from rasterio.transform import Affine
    import geopandas as gpd
    from shapely.geometry import shape
    from rasterio import features  


    # 步骤2: 提取 G 波段（绿色通道）
    g_channel = image[:, :, 1]  # 索引1对应绿色通道（假设数组为RGB顺序）


    # 1. 创建虚拟栅格
    transform = Affine(2, 0, 0, 0, -2, 500)  # 分辨率2m，原点(0,500)



    with rasterio.MemoryFile() as memfile:
        with memfile.open(
            driver='GTiff',
            height=g_channel.shape[0],
            width=g_channel.shape[1],
            count=1,
            dtype=g_channel.dtype,
            crs=crs_wkt,  # 假设为UTM坐标系
            transform=transform
        ) as dataset:
            dataset.write(g_channel, 1)  # 写入数据
            
            # 2. 提取多边形要素
            shapes_gen = rasterio.features.shapes(
                source=dataset.read(1),
                transform=dataset.transform
            )
            
            # 3. 构建GeoDataFrame
            geometries = []
            values = []
            for geom, val in shapes_gen:
                # 添加条件判断：跳过值为0的像素
                if not np.isclose(val, 0.0, atol=1e-6):  # 使用容差处理浮点数精度
                    geometries.append(shape(geom))
                    values.append(val)

            gdf = gpd.GeoDataFrame(
                {'elevation': values},
                geometry=geometries,
                crs=dataset.crs
            )

            del shapes_gen
            gc.collect()


    # 4. 保存为SHP
    gdf.to_file(Scheme_Save_Path+'/x0'+str(value_v)+'/output_2m_polygons.shp')


    Build_polygons_Path_2m = Scheme_Save_Path+'/x0'+str(value_v)+'/output_2m_polygons.shp'

    Complete_information = True


    # 释放大数组对象
    del image, building_mask, labeled_mask, g_channel, geometries, values
    gc.collect()  # 强制垃圾回收
# ---------- end gh_cpython ----------
gh_cpython_2 = GH_CPython(
    Run_if=gh_cpython.Complete_information,
    SampleCUT_Path=image_crop.save_Path,
    Scheme_Save_Path=working_spaces,
    value_v=epoch_read.value_v)  # -> Build_polygons_Path_5m, Complete_information; inputs Run_if: list, SampleCUT_Path: list, Scheme_Save_Path: list, value_v: list
#   port Run_if: [required] - [type = int] - [default = None] Descripe your input here * bullet point. * bullet point
#   port Build_polygons_Path_5m: indicate your output description here. refers to a new line.
# ---------- gh_cpython_2: Python ----------
# -*- coding: utf-8 -*-
import gc
import os
import numpy as np
import geopandas as gpd
import pyproj
from skimage.measure import label, regionprops
from shapely.geometry import Polygon
from PIL import Image
from pyproj import CRS
print(pyproj.datadir.get_data_dir())  # 打印当前PROJ路径
import matplotlib.pyplot as plt
import shutil
import os
import pyproj
from pyproj import CRS


if Run_if==True:

    proj_db_path = r"d:/software/python310/lib/site-packages/pyproj/proj_dir/share/proj"
    # 1. 设置PROJ数据库路径（关键修复！）
    os.environ['PROJ_LIB'] = proj_db_path  # 关键设置！
    pyproj.datadir.set_data_dir(proj_db_path)  # 显式指定路径

    # 步骤3：验证路径
    print("当前PROJ路径:", pyproj.datadir.get_data_dir())  # 检查是否生效
    print("proj.db是否存在:", os.path.exists(os.path.join(proj_db_path, "proj.db")))  # 确认文件存在


    # 手动定义UTM Zone 50N坐标系（EPSG:32650的WKT）
    crs_wkt = """
    PROJCS["WGS 84 / UTM zone 50N",
        GEOGCS["WGS 84",
            DATUM["WGS_1984",
                SPHEROID["WGS 84",6378137,298.257223563,
                    AUTHORITY["EPSG","7030"]],
                AUTHORITY["EPSG","6326"]],
            PRIMEM["Greenwich",0,
                AUTHORITY["EPSG","8901"]],
            UNIT["degree",0.0174532925199433,
                AUTHORITY["EPSG","9122"]],
            AUTHORITY["EPSG","4326"]],
        PROJECTION["Transverse_Mercator"],
        PARAMETER["latitude_of_origin",0],
        PARAMETER["central_meridian",117],
        PARAMETER["scale_factor",0.9996],
        PARAMETER["false_easting",500000],
        PARAMETER["false_northing",0],
        UNIT["metre",1,
            AUTHORITY["EPSG","9001"]],
        AXIS["Easting",EAST],
        AXIS["Northing",NORTH],
        AUTHORITY["EPSG","32650"]]
    """

    '''读取图片'''
    srcPath_input = SampleCUT_Path
    # 读取图像并转为数组
    # 2. 读取图像
    img = Image.open(srcPath_input)
    image = np.array(img)
    img.close()  # 显式关闭



    # 创建建筑掩膜：R=245, B=1
    building_mask = (image[:, :, 0] == 245) & (image[:, :, 2] == 1)
    # 连通域标记（8邻域）
    labeled_mask = label(building_mask, connectivity=2)


    # 遍历每个连通域（建筑）
    for region in regionprops(labeled_mask):
        # 获取当前建筑的像素坐标
        coords = region.coords
        
        # 提取原始G值（高度值）
        g_values = image[coords[:, 0], coords[:, 1], 1]
        
        # 计算平均高度
        avg_height = int(np.mean(g_values))
        
        # 更新G通道
        image[coords[:, 0], coords[:, 1], 1] = avg_height



    '''将不透水的值转化为0'''
    impervious_mask = (image[:, :, 0] == 15) & (image[:, :, 1] == 15) & (image[:, :, 2] == 15)
    image[impervious_mask] = [0, 0, 0]  # 直接修改原数组


    import numpy as np
    import rasterio
    from rasterio.transform import Affine
    from rasterio.enums import Resampling
    import geopandas as gpd
    from shapely.geometry import shape
    from rasterio import features  


    # 原始2米分辨率数据
    g_channel = image[:, :, 1].astype(np.float32)  # 确保使用浮点数类型

    # 计算目标网格尺寸
    factor = 5 / 2  # 5米/2米=2.5
    target_shape = (
        int(g_channel.shape[0] / factor),
        int(g_channel.shape[1] / factor)
    )


    # 1. 创建虚拟栅格
    transform = Affine(2, 0, 0, 0, -2, 500)  # 分辨率2m，原点(0,500)

    # 创建原始栅格（2米分辨率）
    transform_2m = Affine(2, 0, 0, 0, -2, 500)  # 分辨率2m，原点(0,500)
    with rasterio.MemoryFile() as memfile_2m:
        with memfile_2m.open(
            driver='GTiff',
            height=g_channel.shape[0],
            width=g_channel.shape[1],
            count=1,
            dtype=g_channel.dtype,
            crs=crs_wkt,
            transform=transform_2m
        ) as src:
            src.write(g_channel, 1)
            
            # 创建目标栅格（5米分辨率）
            transform_5m = Affine(5, 0, 0, 0, -5, 500)  # 分辨率5m
            with rasterio.MemoryFile() as memfile_5m:
                with memfile_5m.open(
                    driver='GTiff',
                    height=target_shape[0],
                    width=target_shape[1],
                    count=1,
                    dtype=src.dtypes[0],
                    crs=src.crs,
                    transform=transform_5m
                ) as dst:
                    # 执行重采样
                    rasterio.warp.reproject(
                        source=rasterio.band(src, 1),
                        destination=rasterio.band(dst, 1),
                        src_transform=src.transform,
                        src_crs=src.crs,
                        dst_transform=dst.transform,
                        dst_crs=dst.crs,
                        resampling=Resampling.max,  # 使用平均值重采样
                    )
                    
                    # 从重采样后的栅格提取矢量
                    resampled_data = dst.read(1)  # 读取重采样后的数据
                    shapes_gen = features.shapes(
                        source=resampled_data,
                        transform=dst.transform
                    )
                    
                    # 构建GeoDataFrame - 关键修改：跳过0值像素
                    geometries = []
                    values = []
                    for geom, val in shapes_gen:
                        # 添加条件判断：跳过值为0的像素
                        if not np.isclose(val, 0.0, atol=1e-6):  # 使用容差处理浮点数精度
                            geometries.append(shape(geom))
                            values.append(val)
                    
                    gdf = gpd.GeoDataFrame(
                        {'elevation_5m': values},
                        geometry=geometries,
                        crs=dst.crs
                    )

    gdf['geometry'] = gdf['geometry'].simplify(tolerance=3)
    # 保存重采样后的SHP
    gdf.to_file(Scheme_Save_Path+'/x0'+str(value_v)+'/output_5m_polygons.shp')
    Build_polygons_Path_5m = Scheme_Save_Path+'x0'+str(value_v)+'/output_5m_polygons.shp'

    Complete_information = True

    # 图像处理完成后
    del building_mask, labeled_mask, impervious_mask
    gc.collect()

    # 栅格处理完成后
    del resampled_data, shapes_gen, geometries, values
    gc.collect()

    # 最终清理
    del gdf, image, g_channel
    gc.collect()
# ---------- end gh_cpython_2 ----------
gh_cpython_3 = GH_CPython(
    Run_if=gh_cpython_2.Complete_information,
    Build_polygons_Path_5m=gh_cpython_2.Build_polygons_Path_5m,
    Scheme_Save_Path=working_spaces,
    value_v=epoch_read.value_v)  # -> BuildingPoint_Path, Complete_information; inputs Run_if: list, Build_polygons_Path_5m: list, Scheme_Save_Path: list, value_v: list
#   port Build_polygons_Path_5m: [required] - [type = int] - [default = None] Descripe your input here * bullet point. * bullet point
#   port BuildingPoint_Path: indicate your output description here. refers to a new line.
# ---------- gh_cpython_3: Python ----------
# -*- coding: utf-8 -*-
import geopandas as gpd
from shapely.geometry import Point
import openpyxl
import gc  # 添加垃圾回收模块
import pandas as pd  # 用于内存优化

if Run_if == True:

    # 1. 读取 Shapefile 文件
    gdf = gpd.read_file(Build_polygons_Path_5m)

    # 2. 要素节点转点并记录坐标
    points_list = []
    for idx, row in gdf.iterrows():
        # 提取多边形所有节点坐标 [1,3](@ref)
        if row.geometry.geom_type == 'Polygon':
            coords = list(row.geometry.exterior.coords)
        elif row.geometry.geom_type == 'MultiPolygon':
            coords = []
            for poly in row.geometry.geoms:
                coords.extend(list(poly.exterior.coords))
        
        # 为每个节点创建点要素并记录属性
        for i, coord in enumerate(coords):
            point = Point(coord)
            points_list.append({
                **row.drop('geometry').to_dict(),  # 保留原始属性
                'node_id': f"{idx}_{i}",           # 生成唯一节点ID
                'X': coord[0],                     # 记录X坐标
                'Y': coord[1],                     # 记录Y坐标
                'geometry': point                   # 点几何
            })

    # 3. 创建点要素GeoDataFrame
    points_gdf = gpd.GeoDataFrame(points_list, crs=gdf.crs)



    # 4. 缓存清理点1：释放不再需要的大对象[7,8](@ref)
    del points_list, gdf  # 删除原始列表和GeoDataFrame
    gc.collect()  # 强制垃圾回收


    # 4. 保存为CSV（不含几何列）
    points_gdf = points_gdf.drop(columns=['geometry'])


    # 按 '_' 分隔符拆分，并扩展为两列
    points_gdf[['prefix', 'suffix']] = points_gdf['node_id'].str.split('_', n=1, expand=True)

    # 7. 数据类型优化[8](@ref)
    points_gdf['prefix'] = points_gdf['prefix'].astype('int32')  # 32位整数节省内存
    points_gdf['suffix'] = points_gdf['suffix'].astype('int32')  # 32位整数节省内存

    # 8. 导出前内存优化
    points_gdf = points_gdf.copy()  # 创建新副本释放碎片内存[8](@ref)


    points_gdf.to_excel(Scheme_Save_Path+'x0'+str(value_v)+'/output_Building_points.xlsx', index=False)
    BuildingPoint_Path = Scheme_Save_Path+'x0'+str(value_v)+'/output_Building_points.xlsx'
    Complete_information = True

    # 10. 最终缓存清理[7,8](@ref)
    del points_gdf
    gc.collect()
# ---------- end gh_cpython_3 ----------

transform_3d_trees = Transform_3D_Trees(
    Run_if=gh_cpython_3.Complete_information,
    Scheme_Save_Path=working_spaces,
    Green_srcPath_input=image_crop_for_greenarea.save_Path,
    value_v=epoch_read.value_v)  # -> dilated_image_Path, Complete_information; inputs Run_if: list, Scheme_Save_Path: list, Green_srcPath_input: list, value_v: list
#   port Green_srcPath_input: [required] - [type = int] - [default = None] Descripe your input here * bullet point. * bullet point
# ---------- transform_3d_trees: Python ----------
# -*- coding: utf-8 -*-
import os
import numpy as np
import geopandas as gpd
import pyproj
from skimage.measure import label, regionprops
from shapely.geometry import Polygon
from PIL import Image
from pyproj import CRS
print(pyproj.datadir.get_data_dir())  # 打印当前PROJ路径
import matplotlib.pyplot as plt

import cv2
import os
import pyproj
from pyproj import CRS

from rasterio import features  
import numpy as np
import rasterio
from rasterio.transform import Affine
import geopandas as gpd
from shapely.geometry import shape
import gc

if Run_if==True:

    error = 10
    '''读取图片'''

    img_input_sample = Image.open(Green_srcPath_input)

    # 转换为RGB模式
    rgb_input_image = img_input_sample.convert("RGB")
        

    # 获取像素点数据
    pixels = rgb_input_image.load()
    width, height = rgb_input_image.size #获取图片的尺寸


    '''特定地表类型二值转化&像素矫正'''
    data_re = []

    '''重构二值图像'''
    for x in range(width):
        for y in range(height):
            r, g, b = pixels[x, y]

            #建筑矫正
            if (60-error)<= r <=(60+error) and  (170-error)<=g<=(170+error) and  (10-error)<=b<=(10+error):
                data_re.append(255)

            else:
                #剩余数据填充原值
                data_re.append(0)

    '''包装Nparray'''
    data_re = np.array(data_re, dtype=np.uint8)
    data_re = data_re.reshape(250,250)



    def rotate_90(matrix):
        # 转置
        transposed = np.transpose(matrix)
        # 水平镜像
        # rotated = transposed[:, ::-1]
        return transposed



    data_re = rotate_90(data_re)


    '''去除噪点'''
    # 使用形态学操作去除噪点小岛
    iterations_value = 1 #注：当iterations_value为i时，则侵蚀面积为ixi的噪点小岛
    MakeBorder = 4 #图片外围增加的像素数量

    data_re = cv2.copyMakeBorder(data_re, MakeBorder, MakeBorder, MakeBorder, MakeBorder, cv2.BORDER_CONSTANT, value=(0)) #外围增加0像素

    kernel = np.ones((2, 2), np.uint8)
    eroded_image = cv2.erode(data_re, kernel, iterations=iterations_value) #侵蚀像素

    dilated_image = cv2.dilate(eroded_image, kernel, iterations=iterations_value) #膨胀像素，膨胀后像素向下方和右方各移动一个像素
    dilated_image_222 = dilated_image[(MakeBorder+iterations_value):(250+MakeBorder+iterations_value),(MakeBorder+iterations_value):(250+MakeBorder+iterations_value)] #矫正膨胀的偏移量

    np.save(Scheme_Save_Path+'/x0'+str(value_v)+'/dilated_image_222.npy', dilated_image_222) 

    dilated_image_Path = Scheme_Save_Path+'/x0'+str(value_v)+'/dilated_image_222.npy'
    
    # 在形态学操作后添加
    cv2.destroyAllWindows()  # 关闭任何潜在的OpenCV窗口

    del data_re, eroded_image, dilated_image
    gc.collect()  # 强制垃圾回收[6,8](@ref)
    
    Complete_information = True
# ---------- end transform_3d_trees ----------
green_buffe = Green_Buffe(
    Run_if=transform_3d_trees.Complete_information,
    dilated_image_Path=transform_3d_trees.dilated_image_Path,
    value_v=epoch_read.value_v,
    Build_polygons_Path_2m=gh_cpython.Build_polygons_Path_2m,
    Scheme_Save_Path=working_spaces)  # -> Erased_green_polygons_Path, green_polygons_Path, Complete_information; inputs Run_if: list, dilated_image_Path: list, value_v: list, Build_polygons_Path_2m: list, Scheme_Save_Path: list
#   port dilated_image_Path: [required] - [type = int] - [default = None] Descripe your input here * bullet point. * bullet point
# ---------- green_buffe: Python ----------
# -*- coding: utf-8 -*-
import os
import numpy as np
import geopandas as gpd
import pyproj
from skimage.measure import label, regionprops
from shapely.geometry import Polygon
from PIL import Image
from pyproj import CRS
print(pyproj.datadir.get_data_dir())  # 打印当前PROJ路径
import matplotlib.pyplot as plt

import cv2
import os
import pyproj
from pyproj import CRS

from rasterio import features  
import numpy as np
import rasterio
from rasterio.transform import Affine
import geopandas as gpd
from shapely.geometry import shape


import gc



if Run_if ==True:

    proj_db_path = r"d:/software/python310/lib/site-packages/pyproj/proj_dir/share/proj"
    # 1. 设置PROJ数据库路径（关键修复！）
    os.environ['PROJ_LIB'] = proj_db_path  # 关键设置！
    pyproj.datadir.set_data_dir(proj_db_path)  # 显式指定路径

    # 步骤3：验证路径
    print("当前PROJ路径:", pyproj.datadir.get_data_dir())  # 检查是否生效
    print("proj.db是否存在:", os.path.exists(os.path.join(proj_db_path, "proj.db")))  # 确认文件存在


    # 手动定义UTM Zone 50N坐标系（EPSG:32650的WKT）
    crs_wkt = """
    PROJCS["WGS 84 / UTM zone 50N",
        GEOGCS["WGS 84",
            DATUM["WGS_1984",
                SPHEROID["WGS 84",6378137,298.257223563,
                    AUTHORITY["EPSG","7030"]],
                AUTHORITY["EPSG","6326"]],
            PRIMEM["Greenwich",0,
                AUTHORITY["EPSG","8901"]],
            UNIT["degree",0.0174532925199433,
                AUTHORITY["EPSG","9122"]],
            AUTHORITY["EPSG","4326"]],
        PROJECTION["Transverse_Mercator"],
        PARAMETER["latitude_of_origin",0],
        PARAMETER["central_meridian",117],
        PARAMETER["scale_factor",0.9996],
        PARAMETER["false_easting",500000],
        PARAMETER["false_northing",0],
        UNIT["metre",1,
            AUTHORITY["EPSG","9001"]],
        AXIS["Easting",EAST],
        AXIS["Northing",NORTH],
        AUTHORITY["EPSG","32650"]]
    """


    dilated_image_222 = np.load(dilated_image_Path)



    # 1. 创建虚拟栅格
    transform = Affine(2, 0, 0, 0, -2, 500)  # 分辨率2m，原点(0,500)


    with rasterio.MemoryFile() as memfile:
        with memfile.open(
            driver='GTiff',
            height=dilated_image_222.shape[0],
            width=dilated_image_222.shape[1],
            count=1,
            dtype=dilated_image_222.dtype,
            crs=crs_wkt,  # 假设为UTM坐标系
            transform=transform
        ) as dataset:
            dataset.write(dilated_image_222, 1)  # 写入数据
            
            # 2. 提取多边形要素
            shapes_gen = rasterio.features.shapes(
                source=dataset.read(1),
                transform=dataset.transform
            )
            
            # 3. 构建GeoDataFrame
            geometries = []
            values = []
            for geom, val in shapes_gen:
                # 添加条件判断：跳过值为0的像素
                if not np.isclose(val, 0.0, atol=1e-6):  # 使用容差处理浮点数精度
                    geometries.append(shape(geom))
                    values.append(val)
            
            gdf = gpd.GeoDataFrame(
                {'elevation': values},
                geometry=geometries,
                crs=dataset.crs
            )

    gdf['geometry'] = gdf['geometry'].simplify(tolerance=4)

    # 4. 保存为SHP
    gdf.to_file(Scheme_Save_Path+'/x0'+str(value_v)+'/Green_polygons.shp')
    green_polygons_Path = Scheme_Save_Path+'/x0'+str(value_v)+'/Green_polygons.shp'

    green_polygons = gpd.read_file(Scheme_Save_Path+'/x0'+str(value_v)+'/Green_polygons.shp')


    import geopandas as gpd
    from shapely.geometry import Polygon
    import matplotlib.pyplot as plt

    # 1. 读取原始面状要素SHP文件
    input_path = Build_polygons_Path_2m
    gdf = gpd.read_file(input_path)



    # 3. 创建5米缓冲区
    gdf_buffer = gdf.copy()  # 创建副本保留原始属性
    gdf_buffer['geometry'] = gdf_buffer.geometry.buffer(5)  # 5米缓冲区


    buffer_polygons = gdf_buffer
    # 4. 保存缓冲区Shapefile
    output_path = Scheme_Save_Path+'/x0'+str(value_v)+'/output_5m_buffer.shp'
    gdf_buffer.to_file(output_path)



    # 3. 执行擦除操作（空间差异分析）
    result = gpd.overlay(
        green_polygons,
        buffer_polygons,
        how='difference',  # 擦除操作
        keep_geom_type=True
    )

    # 4. 保存处理结果

    Erased_green_polygons_Path = Scheme_Save_Path+'/x0'+str(value_v)+'/Erased_Green_Polygons.shp'
    result.to_file(Erased_green_polygons_Path)


    del dilated_image_222
    gc.collect()  # 强制垃圾回收[6,8](@ref)


    cv2.destroyAllWindows()  # 关闭任何潜在的OpenCV窗口

    del gdf, geometries, values, shapes_gen
    gc.collect()

    Complete_information = True
# ---------- end green_buffe ----------
gh_cpython_4 = GH_CPython(
    Run_if=green_buffe.Complete_information,
    Scheme_Save_Path=working_spaces,
    value_v=epoch_read.value_v,
    Erased_green_polygons_Path=green_buffe.Erased_green_polygons_Path,
    green_polygons_Path=green_buffe.green_polygons_Path,
    Intervals_trees=intervals_trees)  # -> GreenPoint_Path, Complete_information; inputs Run_if: list, Scheme_Save_Path: list, value_v: list, Erased_green_polygons_Path: list, green_polygons_Path: list, Intervals_trees: list
#   port Erased_green_polygons_Path: [required] - [type = int] - [default = None] Descripe your input here * bullet point. * bullet point
#   port GreenPoint_Path: indicate your output description here. refers to a new line.
# ---------- gh_cpython_4: Python ----------
# -*- coding: utf-8 -*-
'''创建点阵'''
import geopandas as gpd
import numpy as np
from shapely.geometry import Point
import gc
import os

if Run_if==True:

    green_polygons = gpd.read_file(green_polygons_Path)
    Erased_green_polygons = gpd.read_file(Erased_green_polygons_Path)

    # 获取整个图层的边界范围
    minx, miny, maxx, maxy = Erased_green_polygons.total_bounds

    # 计算点阵行列数（10米间距）
    x_spacing = Intervals_trees
    y_spacing = Intervals_trees
    x_count = int((maxx - minx) / x_spacing) + 1
    y_count = int((maxy - miny) / y_spacing) + 1

    # 生成网格坐标点[6,7](@ref)
    x_coords = np.linspace(minx, maxx, x_count)
    y_coords = np.linspace(miny, maxy, y_count)
    grid_x, grid_y = np.meshgrid(x_coords, y_coords)

    # 创建点几何对象
    points = [
        Point(x, y) 
        for x, y in zip(grid_x.flatten(), grid_y.flatten())
    ]

    # 构建点GeoDataFrame
    points_gdf = gpd.GeoDataFrame(geometry=points, crs=green_polygons.crs)

    # 筛选落在多边形内的点[3,5](@ref)
    valid_points = gpd.sjoin(
        points_gdf, 
        green_polygons, 
        how="inner", 
        predicate="within"
    ).drop_duplicates(subset=['geometry'])



    # 保存结果
    PointGrid_output_path = Scheme_Save_Path+'/x0'+str(value_v)+'/PointGrid_10m.shp'
    valid_points.to_file(PointGrid_output_path)








    # 1. 读取 Shapefile 文件
    point_gdf  = gpd.read_file(PointGrid_output_path)


    # 提取 X/Y 坐标（自动处理所有点）
    point_gdf["X"] = point_gdf.geometry.x  # 经度坐标 [3](@ref)
    point_gdf["Y"] = point_gdf.geometry.y  # 纬度坐标 [3](@ref)


    # 创建纯数据表（移除几何列）
    coord_df = point_gdf.drop(columns="geometry")
    # 提取坐标后立即移除几何列
    coord_df = point_gdf[["X", "Y"]]  # 只保留坐标列
    del point_gdf  # 立即删除原始GeoDataFrame

    # 保存为 Excel 文件
    coord_df.to_excel(Scheme_Save_Path+'/x0'+str(value_v)+'/output_Green_points.xlsx', index=False)
    GreenPoint_Path = Scheme_Save_Path+'/x0'+str(value_v)+'/output_Green_points.xlsx'


    gc.collect()  # 强制垃圾回收[7,8](@ref)

    del green_polygons, Erased_green_polygons, points_gdf
    gc.collect()  # 强制垃圾回收[7,8](@ref)

    del valid_points
    gc.collect()



    Complete_information = True
# ---------- end gh_cpython_4 ----------
panel_21 = Panel(gh_cpython.Complete_information)  # disabled
panel_22 = Panel(gh_cpython_2.Build_polygons_Path_5m)  # disabled
panel_23 = Panel(gh_cpython_2.Complete_information)  # disabled
transform_3d_trees_2 = Transform_3D_Trees(
    Run_if=gh_cpython_4.Complete_information,
    Scheme_Save_Path=working_spaces,
    Green_srcPath_input=image_crop_for_greenarea.save_Path,
    value_v=epoch_read.value_v)  # -> dilated_image_Path, Complete_information; inputs Run_if: list, Scheme_Save_Path: list, Green_srcPath_input: list, value_v: list
#   port Green_srcPath_input: [required] - [type = int] - [default = None] Descripe your input here * bullet point. * bullet point
# ---------- transform_3d_trees_2: Python ----------
# -*- coding: utf-8 -*-
import os
import numpy as np
import geopandas as gpd
import pyproj
from skimage.measure import label, regionprops
from shapely.geometry import Polygon
from PIL import Image
from pyproj import CRS
print(pyproj.datadir.get_data_dir())  # 打印当前PROJ路径
import matplotlib.pyplot as plt

import cv2
import os
import pyproj
from pyproj import CRS

from rasterio import features  
import numpy as np
import rasterio
from rasterio.transform import Affine
import geopandas as gpd
from shapely.geometry import shape
import gc

if Run_if==True:

    error = 10
    '''读取图片'''

    img_input_sample = Image.open(Green_srcPath_input)

    # 转换为RGB模式
    rgb_input_image = img_input_sample.convert("RGB")
        

    # 获取像素点数据
    pixels = rgb_input_image.load()
    width, height = rgb_input_image.size #获取图片的尺寸


    '''特定地表类型二值转化&像素矫正'''
    data_re = []

    '''重构二值图像'''
    for x in range(width):
        for y in range(height):
            r, g, b = pixels[x, y]

            #建筑矫正
            if (170-error)<= r <=(170+error) and  (255-error)<=g<=(255+error) and  (10-error)<=b<=(10+error):
                data_re.append(255)

            else:
                #剩余数据填充原值
                data_re.append(0)

    '''包装Nparray'''
    data_re = np.array(data_re, dtype=np.uint8)
    data_re = data_re.reshape(250,250)



    def rotate_90(matrix):
        # 转置
        transposed = np.transpose(matrix)
        # 水平镜像
        # rotated = transposed[:, ::-1]
        return transposed



    data_re = rotate_90(data_re)


    '''去除噪点'''
    # 使用形态学操作去除噪点小岛
    iterations_value = 1 #注：当iterations_value为i时，则侵蚀面积为ixi的噪点小岛
    MakeBorder = 4 #图片外围增加的像素数量

    data_re = cv2.copyMakeBorder(data_re, MakeBorder, MakeBorder, MakeBorder, MakeBorder, cv2.BORDER_CONSTANT, value=(0)) #外围增加0像素

    kernel = np.ones((2, 2), np.uint8)
    eroded_image = cv2.erode(data_re, kernel, iterations=iterations_value) #侵蚀像素

    dilated_image = cv2.dilate(eroded_image, kernel, iterations=iterations_value) #膨胀像素，膨胀后像素向下方和右方各移动一个像素
    dilated_image_222 = dilated_image[(MakeBorder+iterations_value):(250+MakeBorder+iterations_value),(MakeBorder+iterations_value):(250+MakeBorder+iterations_value)] #矫正膨胀的偏移量

    np.save(Scheme_Save_Path+'/x0'+str(value_v)+'/Grass_dilated_image_222.npy', dilated_image_222) 

    dilated_image_Path = Scheme_Save_Path+'/x0'+str(value_v)+'/Grass_dilated_image_222.npy'
    
    # 在形态学操作后添加
    cv2.destroyAllWindows()  # 关闭任何潜在的OpenCV窗口

    del data_re, eroded_image, dilated_image
    gc.collect()  # 强制垃圾回收[6,8](@ref)
    
    Complete_information = True
# ---------- end transform_3d_trees_2 ----------
green_buffe_2 = Green_Buffe(
    Run_if=transform_3d_trees_2.Complete_information,
    dilated_image_Path=transform_3d_trees_2.dilated_image_Path,
    value_v=epoch_read.value_v,
    Build_polygons_Path_2m=gh_cpython.Build_polygons_Path_2m,
    Scheme_Save_Path=working_spaces)  # -> Erased_green_polygons_Path, green_polygons_Path, Complete_information; inputs Run_if: list, dilated_image_Path: list, value_v: list, Build_polygons_Path_2m: list, Scheme_Save_Path: list
#   port dilated_image_Path: [required] - [type = int] - [default = None] Descripe your input here * bullet point. * bullet point
# ---------- green_buffe_2: Python ----------
# -*- coding: utf-8 -*-
import os
import numpy as np
import geopandas as gpd
import pyproj
from skimage.measure import label, regionprops
from shapely.geometry import Polygon
from PIL import Image
from pyproj import CRS
print(pyproj.datadir.get_data_dir())  # 打印当前PROJ路径
import matplotlib.pyplot as plt

import cv2
import os
import pyproj
from pyproj import CRS

from rasterio import features  
import numpy as np
import rasterio
from rasterio.transform import Affine
import geopandas as gpd
from shapely.geometry import shape


import gc



if Run_if ==True:

    proj_db_path = r"d:/software/python310/lib/site-packages/pyproj/proj_dir/share/proj"
    # 1. 设置PROJ数据库路径（关键修复！）
    os.environ['PROJ_LIB'] = proj_db_path  # 关键设置！
    pyproj.datadir.set_data_dir(proj_db_path)  # 显式指定路径

    # 步骤3：验证路径
    print("当前PROJ路径:", pyproj.datadir.get_data_dir())  # 检查是否生效
    print("proj.db是否存在:", os.path.exists(os.path.join(proj_db_path, "proj.db")))  # 确认文件存在


    # 手动定义UTM Zone 50N坐标系（EPSG:32650的WKT）
    crs_wkt = """
    PROJCS["WGS 84 / UTM zone 50N",
        GEOGCS["WGS 84",
            DATUM["WGS_1984",
                SPHEROID["WGS 84",6378137,298.257223563,
                    AUTHORITY["EPSG","7030"]],
                AUTHORITY["EPSG","6326"]],
            PRIMEM["Greenwich",0,
                AUTHORITY["EPSG","8901"]],
            UNIT["degree",0.0174532925199433,
                AUTHORITY["EPSG","9122"]],
            AUTHORITY["EPSG","4326"]],
        PROJECTION["Transverse_Mercator"],
        PARAMETER["latitude_of_origin",0],
        PARAMETER["central_meridian",117],
        PARAMETER["scale_factor",0.9996],
        PARAMETER["false_easting",500000],
        PARAMETER["false_northing",0],
        UNIT["metre",1,
            AUTHORITY["EPSG","9001"]],
        AXIS["Easting",EAST],
        AXIS["Northing",NORTH],
        AUTHORITY["EPSG","32650"]]
    """


    dilated_image_222 = np.load(dilated_image_Path)



    # 1. 创建虚拟栅格
    transform = Affine(2, 0, 0, 0, -2, 500)  # 分辨率2m，原点(0,500)


    with rasterio.MemoryFile() as memfile:
        with memfile.open(
            driver='GTiff',
            height=dilated_image_222.shape[0],
            width=dilated_image_222.shape[1],
            count=1,
            dtype=dilated_image_222.dtype,
            crs=crs_wkt,  # 假设为UTM坐标系
            transform=transform
        ) as dataset:
            dataset.write(dilated_image_222, 1)  # 写入数据
            
            # 2. 提取多边形要素
            shapes_gen = rasterio.features.shapes(
                source=dataset.read(1),
                transform=dataset.transform
            )
            
            # 3. 构建GeoDataFrame
            geometries = []
            values = []
            for geom, val in shapes_gen:
                # 添加条件判断：跳过值为0的像素
                if not np.isclose(val, 0.0, atol=1e-6):  # 使用容差处理浮点数精度
                    geometries.append(shape(geom))
                    values.append(val)
            
            gdf = gpd.GeoDataFrame(
                {'elevation': values},
                geometry=geometries,
                crs=dataset.crs
            )

    gdf['geometry'] = gdf['geometry'].simplify(tolerance=4)

    # 4. 保存为SHP
    gdf.to_file(Scheme_Save_Path+'/x0'+str(value_v)+'/Grass_polygons.shp')
    green_polygons_Path = Scheme_Save_Path+'/x0'+str(value_v)+'/Grass_polygons.shp'

    green_polygons = gpd.read_file(Scheme_Save_Path+'/x0'+str(value_v)+'/Grass_polygons.shp')


    import geopandas as gpd
    from shapely.geometry import Polygon
    import matplotlib.pyplot as plt

    # 1. 读取原始面状要素SHP文件
    input_path = Build_polygons_Path_2m
    gdf = gpd.read_file(input_path)



    # 3. 创建5米缓冲区
    gdf_buffer = gdf.copy()  # 创建副本保留原始属性
    gdf_buffer['geometry'] = gdf_buffer.geometry.buffer(5)  # 5米缓冲区


    buffer_polygons = gdf_buffer
    # 4. 保存缓冲区Shapefile
    output_path = Scheme_Save_Path+'/x0'+str(value_v)+'/output_5m_buffer.shp'
    gdf_buffer.to_file(output_path)



    # 3. 执行擦除操作（空间差异分析）
    result = gpd.overlay(
        green_polygons,
        buffer_polygons,
        how='difference',  # 擦除操作
        keep_geom_type=True
    )

    # 4. 保存处理结果

    Erased_green_polygons_Path = Scheme_Save_Path+'/x0'+str(value_v)+'/Erased_Grass_Polygons.shp'
    result.to_file(Erased_green_polygons_Path)


    del dilated_image_222
    gc.collect()  # 强制垃圾回收[6,8](@ref)


    cv2.destroyAllWindows()  # 关闭任何潜在的OpenCV窗口

    del gdf, geometries, values, shapes_gen
    gc.collect()

    Complete_information = True
# ---------- end green_buffe_2 ----------
panel_24 = Panel(transform_3d_trees.Complete_information)  # disabled
gh_cpython_5 = GH_CPython(
    Run_if=green_buffe_2.Complete_information,
    Scheme_Save_Path=working_spaces,
    Green_point_Pathaaa=gh_cpython_4.GreenPoint_Path,
    value_v=epoch_read.value_v,
    Erased_green_polygons_Path=green_buffe_2.Erased_green_polygons_Path,
    green_polygons_Path=green_buffe_2.green_polygons_Path,
    Intervals_trees=intervals_trees_2)  # -> GreenPoint_Path, Complete_information; inputs Run_if: list, Scheme_Save_Path: list, Green_point_Pathaaa: list, value_v: list, Erased_green_polygons_Path: list, green_polygons_Path: list, Intervals_trees: list
#   port Erased_green_polygons_Path: [required] - [type = int] - [default = None] Descripe your input here * bullet point. * bullet point
#   port GreenPoint_Path: indicate your output description here. refers to a new line.
# ---------- gh_cpython_5: Python ----------
# -*- coding: utf-8 -*-
'''创建点阵'''
import geopandas as gpd
import numpy as np
from shapely.geometry import Point
import gc
import os
import pandas as pd

if Run_if==True:

    green_polygons = gpd.read_file(green_polygons_Path)
    Erased_green_polygons = gpd.read_file(Erased_green_polygons_Path)

    # 获取整个图层的边界范围
    minx, miny, maxx, maxy = Erased_green_polygons.total_bounds

    # 计算点阵行列数（10米间距）
    x_spacing = Intervals_trees
    y_spacing = Intervals_trees
    x_count = int((maxx - minx) / x_spacing) + 1
    y_count = int((maxy - miny) / y_spacing) + 1

    # 生成网格坐标点[6,7](@ref)
    x_coords = np.linspace(minx, maxx, x_count)
    y_coords = np.linspace(miny, maxy, y_count)
    grid_x, grid_y = np.meshgrid(x_coords, y_coords)

    # 创建点几何对象
    points = [
        Point(x, y) 
        for x, y in zip(grid_x.flatten(), grid_y.flatten())
    ]

    # 构建点GeoDataFrame
    points_gdf = gpd.GeoDataFrame(geometry=points, crs=green_polygons.crs)

    # 筛选落在多边形内的点[3,5](@ref)
    valid_points = gpd.sjoin(
        points_gdf, 
        green_polygons, 
        how="inner", 
        predicate="within"
    ).drop_duplicates(subset=['geometry'])



    # 保存结果
    PointGrid_output_path = Scheme_Save_Path+'/x0'+str(value_v)+'/GrassPointGrid_10m.shp'
    valid_points.to_file(PointGrid_output_path)








    # 1. 读取 Shapefile 文件
    point_gdf  = gpd.read_file(PointGrid_output_path)


    # 提取 X/Y 坐标（自动处理所有点）
    point_gdf["X"] = point_gdf.geometry.x  # 经度坐标 [3](@ref)
    point_gdf["Y"] = point_gdf.geometry.y  # 纬度坐标 [3](@ref)


    # 创建纯数据表（移除几何列）
    coord_df = point_gdf.drop(columns="geometry")
    # 提取坐标后立即移除几何列
    coord_df = point_gdf[["X", "Y"]]  # 只保留坐标列
    del point_gdf  # 立即删除原始GeoDataFrame

    # 保存为 Excel 文件
    coord_df.to_excel(Scheme_Save_Path+'/x0'+str(value_v)+'/output_Grass_points.xlsx', index=False)



    df_green = pd.read_excel(Green_point_Pathaaa)
    df_grass =pd.read_excel(Scheme_Save_Path+'/x0'+str(value_v)+'/output_Grass_points.xlsx')
    merged_df = pd.concat([df_green, df_grass], ignore_index=True)

    merged_df.to_excel(Scheme_Save_Path+'/x0'+str(value_v)+'/merged_df.xlsx', index=False)


    GreenPoint_Path = Scheme_Save_Path+'x0'+str(value_v)+'/merged_df.xlsx'






    gc.collect()  # 强制垃圾回收[7,8](@ref)

    del green_polygons, Erased_green_polygons, points_gdf
    gc.collect()  # 强制垃圾回收[7,8](@ref)

    del valid_points
    gc.collect()



    Complete_information = True
# ---------- end gh_cpython_5 ----------

# ---- group: Building
excel_reader = ExcelReader(ReadExcelData=gh_cpython_4.Complete_information, WorkbookPath=gh_cpython_3.BuildingPoint_Path, WorksheetName="Sheet1")  # -> Exceptions, ExcelData
cull_index = CullIndex(List=excel_reader.ExcelData, Indices="0", Wrap=True)
explode_tree = ExplodeTree(Data=cull_index)  # -> Branch0, Branch1, Branch2, Branch3, Branch4, Branch5
construct_point = ConstructPoint(XCoordinate=explode_tree.Branch2, YCoordinate=explode_tree.Branch3, ZCoordinate=0)
create_set = CreateSet(List=explode_tree.Branch4)  # -> Set, Map
member_index = MemberIndex(Set=explode_tree.Branch4, Member=create_set.Set)  # -> Index, Count
list_item = ListItem(List=explode_tree.Branch0, Index=member_index.Index, Wrap=True)
list_item_2 = ListItem(List=construct_point, Index=member_index.Index, Wrap=True)
create_set_2 = CreateSet(List=list_item)  # -> simplify(Set), Map
polyline = PolyLine(Vertices=list_item_2, Closed=Toggle(True))
curve = Curve(simplify(polyline))
unit_z_3 = UnitZ(Factor=create_set_2.Set)
boundary_surfaces_2 = BoundarySurfaces(Edges=curve)
length = Length(Curve=curve)
extrude_3 = Extrude(Base=boundary_surfaces_2, Direction=unit_z_3)
area = Area(Geometry=boundary_surfaces_2)  # -> Area, Centroid
cap_holes_ex = CapHolesEx(Brep=extrude_3)  # -> Brep, Caps, Solid

# ----
gh_cpython_6 = GH_CPython(
    Run_if=green_buffe.Complete_information,
    Green_polygons_Path=green_buffe.green_polygons_Path,
    Scheme_Save_Path=working_spaces,
    value_v=epoch_read.value_v)  # -> GreenOutline_Path, Complete_information; inputs Run_if: list, Green_polygons_Path: list, Scheme_Save_Path: list, value_v: list
#   port Green_polygons_Path: [required] - [type = int] - [default = None] Descripe your input here * bullet point. * bullet point
#   port GreenOutline_Path: indicate your output description here. refers to a new line.
# ---------- gh_cpython_6: Python ----------
# -*- coding: utf-8 -*-
import geopandas as gpd
from shapely.geometry import Point
import openpyxl
import gc  # 添加垃圾回收模块
import pandas as pd  # 用于内存优化



if Run_if == True:


    # 1. 读取 Shapefile 文件
    gdf = gpd.read_file(Green_polygons_Path)

    # 2. 要素节点转点并记录坐标
    points_list = []
    for idx, row in gdf.iterrows():
        # 提取多边形所有节点坐标 [1,3](@ref)
        if row.geometry.geom_type == 'Polygon':
            coords = list(row.geometry.exterior.coords)
        elif row.geometry.geom_type == 'MultiPolygon':
            coords = []
            for poly in row.geometry.geoms:
                coords.extend(list(poly.exterior.coords))
        
        # 为每个节点创建点要素并记录属性
        for i, coord in enumerate(coords):
            point = Point(coord)
            points_list.append({
                **row.drop('geometry').to_dict(),  # 保留原始属性
                'node_id': f"{idx}_{i}",           # 生成唯一节点ID
                'X': coord[0],                     # 记录X坐标
                'Y': coord[1],                     # 记录Y坐标
                'geometry': point                   # 点几何
            })

    # 3. 创建点要素GeoDataFrame
    points_gdf = gpd.GeoDataFrame(points_list, crs=gdf.crs)



    # 4. 缓存清理点1：释放不再需要的大对象[7,8](@ref)
    del points_list, gdf  # 删除原始列表和GeoDataFrame
    gc.collect()  # 强制垃圾回收


    # 4. 保存为CSV（不含几何列）
    points_gdf = points_gdf.drop(columns=['geometry'])


    # 按 '_' 分隔符拆分，并扩展为两列
    points_gdf[['prefix', 'suffix']] = points_gdf['node_id'].str.split('_', n=1, expand=True)

    # 7. 数据类型优化[8](@ref)
    points_gdf['prefix'] = points_gdf['prefix'].astype('int32')  # 32位整数节省内存
    points_gdf['suffix'] = points_gdf['suffix'].astype('int32')  # 32位整数节省内存

    # 8. 导出前内存优化
    points_gdf = points_gdf.copy()  # 创建新副本释放碎片内存[8](@ref)


    points_gdf.to_excel(Scheme_Save_Path+'x0'+str(value_v)+'/GreenOutline_Path.xlsx', index=False)
    GreenOutline_Path = Scheme_Save_Path+'x0'+str(value_v)+'/GreenOutline_Path.xlsx'
    Complete_information = True

    # 10. 最终缓存清理[7,8](@ref)
    del points_gdf
    gc.collect()
# ---------- end gh_cpython_6 ----------
panel_25 = Panel(green_buffe_2.green_polygons_Path)  # disabled
gh_cpython_7 = GH_CPython(
    Run_if=green_buffe_2.Complete_information,
    Grass_polygons_Path=green_buffe_2.green_polygons_Path,
    Scheme_Save_Path=working_spaces,
    value_v=epoch_read.value_v)  # -> GrassOutline_Path, Complete_information; inputs Run_if: list, Grass_polygons_Path: list, Scheme_Save_Path: list, value_v: list
#   port Grass_polygons_Path: [required] - [type = int] - [default = None] Descripe your input here * bullet point. * bullet point
#   port GrassOutline_Path: indicate your output description here. refers to a new line.
# ---------- gh_cpython_7: Python ----------
# -*- coding: utf-8 -*-
import geopandas as gpd
from shapely.geometry import Point
import openpyxl
import gc  # 添加垃圾回收模块
import pandas as pd  # 用于内存优化


if Run_if == True:


    # 1. 读取 Shapefile 文件
    gdf = gpd.read_file(Grass_polygons_Path)

    # 2. 要素节点转点并记录坐标
    points_list = []
    for idx, row in gdf.iterrows():
        # 提取多边形所有节点坐标 [1,3](@ref)
        if row.geometry.geom_type == 'Polygon':
            coords = list(row.geometry.exterior.coords)
        elif row.geometry.geom_type == 'MultiPolygon':
            coords = []
            for poly in row.geometry.geoms:
                coords.extend(list(poly.exterior.coords))
        
        # 为每个节点创建点要素并记录属性
        for i, coord in enumerate(coords):
            point = Point(coord)
            points_list.append({
                **row.drop('geometry').to_dict(),  # 保留原始属性
                'node_id': f"{idx}_{i}",           # 生成唯一节点ID
                'X': coord[0],                     # 记录X坐标
                'Y': coord[1],                     # 记录Y坐标
                'geometry': point                   # 点几何
            })

    # 3. 创建点要素GeoDataFrame
    points_gdf = gpd.GeoDataFrame(points_list, crs=gdf.crs)



    # 4. 缓存清理点1：释放不再需要的大对象[7,8](@ref)
    del points_list, gdf  # 删除原始列表和GeoDataFrame
    gc.collect()  # 强制垃圾回收


    # 4. 保存为CSV（不含几何列）
    points_gdf = points_gdf.drop(columns=['geometry'])


    # 按 '_' 分隔符拆分，并扩展为两列
    points_gdf[['prefix', 'suffix']] = points_gdf['node_id'].str.split('_', n=1, expand=True)

    # 7. 数据类型优化[8](@ref)
    points_gdf['prefix'] = points_gdf['prefix'].astype('int32')  # 32位整数节省内存
    points_gdf['suffix'] = points_gdf['suffix'].astype('int32')  # 32位整数节省内存

    # 8. 导出前内存优化
    points_gdf = points_gdf.copy()  # 创建新副本释放碎片内存[8](@ref)


    points_gdf.to_excel(Scheme_Save_Path+'x0'+str(value_v)+'/GrassOutline_Path.xlsx', index=False)
    GrassOutline_Path = Scheme_Save_Path+'x0'+str(value_v)+'/GrassOutline_Path.xlsx'
    Complete_information = True

    # 10. 最终缓存清理[7,8](@ref)
    del points_gdf
    gc.collect()
# ---------- end gh_cpython_7 ----------

excel_reader_2 = ExcelReader(ReadExcelData=gh_cpython_5.Complete_information, WorkbookPath=gh_cpython_5.GreenPoint_Path, WorksheetName="Sheet1")  # -> Exceptions, ExcelData
cull_index_2 = CullIndex(List=excel_reader_2.ExcelData, Indices="0", Wrap=True)
explode_tree_2 = ExplodeTree(Data=cull_index_2)  # -> Branch0, Branch1
construct_point_2 = ConstructPoint(XCoordinate=explode_tree_2.Branch0, YCoordinate=explode_tree_2.Branch1, ZCoordinate=0)
unit_z_4 = UnitZ(Factor="5")
circle = Circle(Plane=construct_point_2, Radius="5")
move = Move(Geometry=circle, Motion=unit_z_4)  # -> Geometry, Transform
unit_z_5 = UnitZ(Factor=1)  # disabled
untrim = Untrim(Surface=move.Geometry)
extrude_4 = Extrude(Direction=unit_z_5)  # disabled

# ---- group: GrassArea
excel_reader_3 = ExcelReader(ReadExcelData=gh_cpython_7.Complete_information, WorkbookPath=gh_cpython_7.GrassOutline_Path, WorksheetName="Sheet1")  # -> Exceptions, ExcelData
cull_index_3 = CullIndex(List=excel_reader_3.ExcelData, Indices="0", Wrap=True)
explode_tree_3 = ExplodeTree(Data=cull_index_3)  # -> Branch0, Branch1, Branch2, Branch3, Branch4, Branch5
construct_point_3 = ConstructPoint(XCoordinate=explode_tree_3.Branch2, YCoordinate=explode_tree_3.Branch3, ZCoordinate="0")
create_set_3 = CreateSet(List=explode_tree_3.Branch4)  # -> Set, Map
member_index_2 = MemberIndex(Set=explode_tree_3.Branch4, Member=create_set_3.Set)  # -> Index, Count
list_item_3 = ListItem(List=construct_point_3, Index=member_index_2.Index, Wrap=True)
polyline_2 = PolyLine(Vertices=list_item_3, Closed=Toggle(True))
curve_2 = Curve(simplify(polyline_2))
unit_z_6 = UnitZ(Factor=Slider(-0.3, range=-10..10))
boundary_surfaces_3 = BoundarySurfaces(Edges=curve_2)
extrude_5 = Extrude(Base=boundary_surfaces_3, Direction=unit_z_6)
cap_holes_ex_2 = CapHolesEx(Brep=extrude_5)  # -> Brep, Caps, Solid

# ---- group: GreenArea
excel_reader_4 = ExcelReader(ReadExcelData=gh_cpython_6.Complete_information, WorkbookPath=gh_cpython_6.GreenOutline_Path, WorksheetName="Sheet1")  # -> Exceptions, ExcelData
cull_index_4 = CullIndex(List=excel_reader_4.ExcelData, Indices="0", Wrap=True)
explode_tree_4 = ExplodeTree(Data=cull_index_4)  # -> Branch0, Branch1, Branch2, Branch3, Branch4, Branch5
construct_point_4 = ConstructPoint(XCoordinate=explode_tree_4.Branch2, YCoordinate=explode_tree_4.Branch3, ZCoordinate="0")
create_set_4 = CreateSet(List=explode_tree_4.Branch4)  # -> Set, Map
member_index_3 = MemberIndex(Set=explode_tree_4.Branch4, Member=create_set_4.Set)  # -> Index, Count
list_item_4 = ListItem(List=construct_point_4, Index=member_index_3.Index, Wrap=True)
polyline_3 = PolyLine(Vertices=list_item_4, Closed=Toggle(True))
curve_3 = Curve(simplify(polyline_3))
unit_z_7 = UnitZ(Factor=Slider(-0.3, range=-10..10))
boundary_surfaces_4 = BoundarySurfaces(Edges=curve_3)
extrude_6 = Extrude(Base=boundary_surfaces_4, Direction=unit_z_7)
cap_holes_ex_3 = CapHolesEx(Brep=extrude_6)  # -> Brep, Caps, Solid

# ----
region_union = RegionUnion(Curves=untrim)
cap_holes_ex_4 = CapHolesEx(Brep=region_union)  # -> Brep, Caps, Solid

opaquemat = HBOpaqueMaterial(
    name="Concrete",
    thickness="0.3",
    conductivity="1.31",
    density="2240",
    spec_heat="836",
    roughness="Rough",
    therm_absp="0.9",
    sol_absp="0.7",
    vis_absp="0.7")  # -> mat; plug-in component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

opaquemat_2 = HBOpaqueMaterial(
    name="Stucco",
    thickness="0.05",
    conductivity="0.72",
    density="1858",
    spec_heat="830",
    roughness="Smooth",
    therm_absp="0.9",
    sol_absp="0.7",
    vis_absp="0.92")  # -> mat; plug-in component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

hb_construction_types = HBConstructionTypes({"SteelFramed", "WoodFramed", "Mass", "Metal Building"}, selected="Mass")
hb_climate_zones = HBClimateZones({"1 - Very Hot": "1", "2 - Hot": "2", "3 - Warm": "3", "4 - Mixed": "4", "5 - Cool": "5", "6 - Cold": "6", "7 - Very Cold": "7", "8 - Subarctic": "8"}, selected="2 - Hot")
constrsetclimate = HBConstructionSetByClimate(climate_zone=hb_climate_zones, constr_type=hb_construction_types)  # -> constr_set; plug-in component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
opaqueconstr = HBOpaqueConstruction(materials=[opaquemat, opaquemat_2])  # -> constr; plug-in component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
exteriorsubset = HBExteriorConstructionSubset(exterior_wall=opaqueconstr, exterior_roof=opaqueconstr, exposed_floor=opaqueconstr)  # -> exterior_set; plug-in component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
constructionset = HBConstructionSet(base_constr_set=constrsetclimate, exterior_subset=exteriorsubset)  # -> constr_set; plug-in component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
roomsolid_3 = HBRoomFromSolid(geo=flatten(cap_holes_ex.Brep), constr_set=constructionset, conditioned=True)  # -> out, rooms; plug-in component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

shadeconstr = HBShadeConstruction(sol_ref="0.25", vis_ref="0.25")  # -> constr; plug-in component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
shade = HBShade(geo=cap_holes_ex_4.Brep, name="green_shape", ep_constr=shadeconstr)  # -> out, shades; plug-in component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

roomsolid_4 = HBRoomFromSolid(geo=flatten(cap_holes_ex_2.Brep), name="grass_a", conditioned=True)  # -> out, rooms; plug-in component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
vegetationmat = HBVegetationMaterial(name="Grass", plant_height="0.15", leaf_area_ind="3", stomat_resist="150", thickness="0.5")  # -> mat; plug-in component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
opaqueconstr_2 = HBOpaqueConstruction(name="GrassGound", materials=vegetationmat)  # -> constr; plug-in component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
ground_3 = HBGround(rooms=roomsolid_4.rooms, soil_constr=opaqueconstr_2)  # -> rooms; plug-in component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

roomsolid_5 = HBRoomFromSolid(geo=flatten(cap_holes_ex_3.Brep), name="forest_a", conditioned=True)  # -> out, rooms; plug-in component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
ground_4 = HBGround(rooms=roomsolid_5.rooms, soil_constr=opaqueconstr_2)  # -> rooms; plug-in component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

panel_26 = Panel("Grassy Lawn")
vizbytype = HBVisualizeByType()  # -> walls, interior_walls, roofs, ceilings, exterior_floors, interior_floors, air_walls, apertures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; disabled; plug-in component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
ground_5 = HBGround(rooms=roomsolid_3.rooms, soil_constr=opaqueconstr)  # -> rooms; plug-in component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
model = HBModel(rooms=flatten([ground_2, ground_3, ground_4, ground, ground_5]), shades=flatten(shade.shades))  # -> out, model; plug-in component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
assigngridsviews = HBAssignGridsAndViews(model=model.model, grids=flatten(sensorgrid))  # -> model; plug-in component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

# ---- group: UWG
panel_27 = Panel("E:/aaa_Rhino_Optimization20250925/Constraint/EWP/oiko.amy.6c3e6e9199ab12df.epw")
calculate_fr_and_gr = GH_CPython(Run_if=image_crop_for_greenarea.Complete_information, Green_save_Path=pc_gan_for_greenarea.green_save_Path)  # -> Forest_Rate, Grass_Rate; inputs Run_if: list, Green_save_Path: list
#   port Green_save_Path: [required] - [type = int] - [default = None] Descripe your input here * bullet point. * bullet point
#   port Forest_Rate: indicate your output description here. refers to a new line.
# ---------- calculate_fr_and_gr: Python ----------
# -*- coding: utf-8 -*-
import numpy as np
from PIL import Image


if Run_if == True:
    # 从文件加载图像（示例）
    image = np.array(Image.open(Green_save_Path))  # 确保图像为 RGB 格式

    '''计算Forest的数量'''
    target_rgb_F = np.array([60, 170, 10], dtype=np.uint8) 
    # 生成布尔掩码（True 表示匹配的像素）
    matches_F = np.all(image == target_rgb_F, axis=2)
    # 统计 True 的数量
    count_F = np.sum(matches_F)

    # print(count_F)


    '''计算Grass的数量'''
    target_rgb_G = np.array([170, 255, 10], dtype=np.uint8) 
    # 生成布尔掩码（True 表示匹配的像素）
    matches_G = np.all(image == target_rgb_G, axis=2)
    # 统计 True 的数量
    count_G = np.sum(matches_G)

    # print(count_G)

    Count_SUM = 250*250

    Forest_Rate = count_F/Count_SUM
    Grass_Rate = count_G/Count_SUM
# ---------- end calculate_fr_and_gr ----------
gh_cpython_8 = GH_CPython(
    Run_if=gh_cpython_5.Complete_information,
    Building_H=flatten(create_set_2.Set),
    Building_Area=flatten(area.Area),
    Building_Length=flatten(length),
    Forest_Rate=flatten(calculate_fr_and_gr.Forest_Rate),
    Grass_Rate=flatten(calculate_fr_and_gr.Grass_Rate))  # -> bldheight_Value, blddensity_Value, vertohor_value, charlength_Value, Forest_Rate, Grass_Rate, Complete_information, Height_constraint, FAR; inputs Run_if: list, Building_H: list, Building_Area: list, Building_Length: list, Forest_Rate: list, Grass_Rate: list
#   port Building_H: [required] - [type = int] - [default = None] Descripe your input here * bullet point. * bullet point
#   port bldheight_Value: indicate your output description here. refers to a new line.
# ---------- gh_cpython_8: Python ----------
# -*- coding: utf-8 -*-
import numpy as np
import pandas as pd
import gc  # 新增垃圾回收模块

if Run_if == True:

    SUM_SIZE_AREA = 250000

    Building_H = np.array(Building_H)
    Building_Area = np.array(Building_Area)
    Building_Length = np.array(Building_Length)

    Building_H = Building_H.reshape(-1,1)
    Building_Area = Building_Area.reshape(-1,1)
    Building_Length = Building_Length.reshape(-1,1)


    '''Merge'''
    result_1d = np.hstack((Building_H, Building_Area,Building_Length))
    result_1d = pd.DataFrame(result_1d)
    result_1d.columns = ['Building_H', 'Building_Area','Building_Length']
    result_1d['Building_V'] = result_1d['Building_H'] *result_1d['Building_Area'] 
    result_1d['vertohor_A'] = result_1d['Building_H'] *result_1d['Building_Length'] 

    blddensity_Value = sum(result_1d['Building_Area'])/SUM_SIZE_AREA
    bldheight_Value = np.mean(result_1d['Building_H'])

    Ssum_vertohor_A = sum(result_1d['vertohor_A'])
    vertohor_value = Ssum_vertohor_A / SUM_SIZE_AREA

    sum_build_V = sum(result_1d['Building_V'])
    charlength_Value = sum_build_V / (blddensity_Value*SUM_SIZE_AREA)



    Height_constraint = max(result_1d['Building_H'] - 75)
    Height_constraint = max(Height_constraint,0)
    Height_constraint = round(Height_constraint, 2)

    FAR = sum_build_V/(SUM_SIZE_AREA*4)
    FAR  = round(FAR, 2)


    Forest_Rate = Forest_Rate
    Grass_Rate = Grass_Rate


    del result_1d

    bldheight_Value = round(bldheight_Value, 2)
    blddensity_Value = round(blddensity_Value, 2)
    vertohor_value = round(vertohor_value, 2)
    charlength_Value = round(charlength_Value, 2)
    Forest_Rate = round(Forest_Rate, 2)
    Grass_Rate = round(Grass_Rate, 2)

    gc.collect()

    Complete_information = True
# ---------- end gh_cpython_8 ----------
gh_cpython_9 = GH_CPython(
    input=gh_cpython_8.Complete_information,
    month="9",
    day="21",
    nday="3",
    epw_path_a=panel_27,
    bldheight_Value=gh_cpython_8.bldheight_Value,
    blddensity_Value=gh_cpython_8.blddensity_Value,
    vertohor_value=gh_cpython_8.vertohor_value,
    charlength_Value=gh_cpython_8.charlength_Value,
    Forest_Rate=gh_cpython_8.Forest_Rate,
    Grass_Rate=gh_cpython_8.Grass_Rate)  # -> Complete_information, Output_EPW_NEW; inputs input: list, month: list, day: list, nday: list, epw_path_a: list, bldheight_Value: list, blddensity_Value: list, vertohor_value: list, charlength_Value: list, Forest_Rate: list, Grass_Rate: list
#   port input: [required] - [type = int] - [default = None] Descripe your input here * bullet point. * bullet point
#   port Complete_information: indicate your output description here. refers to a new line.
# ---------- gh_cpython_9: Python ----------
# -*- coding: utf-8 -*-

import numpy as np
import pandas as pd
from uwg import UWG, BEMDef,RSMDef
import gc
import os
import shutil
import tracemalloc

if _input ==True:


    bldheight_Value = bldheight_Value
    blddensity_Value = blddensity_Value
    vertohor_value = vertohor_value
    charlength_Value = charlength_Value
    Forest_Rate = Forest_Rate
    Grass_Rate = Grass_Rate



    #UWG Calculate
    model = UWG.from_param_args(
        epw_path=r''+epw_path_a,

        month=month,
        day=day,
        nday=nday,

        bldheight=bldheight_Value, #建筑高度
        blddensity=blddensity_Value, #建筑密度
        vertohor=vertohor_value, # 垂直/水平表面积比,建筑立面总面积与场地面积比值
        charlength=charlength_Value,

        grasscover = Grass_Rate, #城市区域草地面积占比   
        treecover = Forest_Rate, #乔木植被投影面积占比    
        zone = '2A'
    )




    model.generate()
    model.simulate()


    model.write_epw()

    Output_EPW_NEW = r'E:/aaa_Rhino_Optimization20250925/Constraint/EWP/oiko.amy.6c3e6e9199ab12df_UWG.epw'

    del model
    gc.collect()
    tracemalloc.stop()

    Complete_information = True
# ---------- end gh_cpython_9 ----------

# ----
panel_28 = Panel(gh_cpython_9.Output_EPW_NEW)  # disabled
analysisperiod = LBAnalysisPeriod(start_month="9", start_day="22", start_hour="14", end_month="9", end_day="22", end_hour="16")  # -> period, hoys, dates; plug-in component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
panel_29 = Panel("""1
1
1""")
constrheader = LBConstructHeader(data_type="Fraction", a_period=analysisperiod.period)  # -> header; plug-in component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
# 由于第一个不连接，
# 因此实际Merge的数据少一个
duplicate_data = DuplicateData(Data=panel_29, Number="1", Order=True)
boolean_toggle_2 = BooleanToggle(True)
data = LBConstructData(header=constrheader, values=duplicate_data)  # -> data; plug-in component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
utcimap = HBUTCIComfortMap(
    model=assigngridsviews,
    epw=gh_cpython_9.Output_EPW_NEW,
    run_period=analysisperiod.period,
    schedule=data,
    run=boolean_toggle_2)  # -> out, env_conds, utci, condition, category, TCP, HSP, CSP; plug-in component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
thermalmtx = HBReadThermalMatrix(comf_result=utcimap.utci, load=boolean_toggle_2)  # -> comf_mtx; plug-in component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

analysisperiod_2 = LBAnalysisPeriod(start_month="9", start_day="22", start_hour="16", end_month="9", end_day="22", end_hour="16")  # -> period, hoys, dates; plug-in component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
vizthermalmap = HBVisualizeThermalMap(comf_mtx=thermalmtx, mesh=flatten(genpts.mesh), period=analysisperiod_2.period)  # -> out, mesh, legend, title, colors, values; plug-in component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

analysisperiod_3 = LBAnalysisPeriod(start_month="9", start_day="22", start_hour="15", end_month="9", end_day="22", end_hour="15")  # -> period, hoys, dates; plug-in component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
vizthermalmap_2 = HBVisualizeThermalMap(comf_mtx=thermalmtx, mesh=flatten(genpts.mesh), period=analysisperiod_3.period)  # -> out, mesh, legend, title, colors, values; plug-in component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

analysisperiod_4 = LBAnalysisPeriod(start_month="9", start_day="22", start_hour="14", end_month="9", end_day="22", end_hour="14")  # -> period, hoys, dates; plug-in component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
vizthermalmap_3 = HBVisualizeThermalMap(comf_mtx=thermalmtx, mesh=flatten(genpts.mesh), period=analysisperiod_4.period)  # -> out, mesh, legend, title, colors, values; plug-in component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

panel_30 = Panel(vizthermalmap_3.values)  # disabled
panel_31 = Panel(vizthermalmap_2.values)  # disabled
panel_32 = Panel(vizthermalmap.values)  # disabled
neural_utci = Panel("33.5")
acceptable_utci = Panel("38.8")
gh_cpython_10 = GH_CPython(
    output_5m_polygons_Path=gh_cpython_2.Build_polygons_Path_5m,
    BuildingTemperature="26.5",
    Acceptable_UTCI="38.5",
    Comfortable_UTCI="33.6",
    UTCI_14=vizthermalmap_3.values,
    UTCI_15=vizthermalmap_2.values,
    UTCI_16=vizthermalmap.values,
    SUM_SIZE="500",
    Grid_Size=gird_size,
    Path=working_spaces,
    epoch=image_crop.epoch_output)  # -> Max_UTCI, Mean_UTCI, Heat_comfortable_Rate, Heat_Acceptable_Rate, Max_Comfort_Area, Complete_information; inputs output_5m_polygons_Path: list, BuildingTemperature: list, Acceptable_UTCI: list, Comfortable_UTCI: list, UTCI_14: list, UTCI_15: list, UTCI_16: list, SUM_SIZE: list, Grid_Size: list, Path: list, epoch: list
#   port UTCI_14: [required] - [type = int] - [default = None] Descripe your input here * bullet point. * bullet point
#   port Max_UTCI: indicate your output description here. refers to a new line.
# ---------- gh_cpython_10: Python ----------
import numpy as np
import pandas as pd
from scipy import ndimage
import geopandas as gpd
import rasterio
from rasterio import features
from rasterio.transform import from_bounds


# 1. 读取SHP文件
gdf = gpd.read_file(output_5m_polygons_Path)  # 替换为你的SHP路径[8](@ref)

# 2. 获取SHP文件的边界范围
bounds = gdf.total_bounds
xmin, ymin, xmax, ymax = bounds

# 3. 定义100x100网格的参数
width, height = 100, 100
transform = from_bounds(xmin, ymin, xmax, ymax, width, height)

# 4. 创建一个空白栅格（全0）
raster = np.zeros((height, width), dtype=np.uint8)

# 5. 将GeoDataFrame中的多边形栅格化（有数据处标记为1）
shapes = [(geom, 1) for geom in gdf.geometry]
rasterized = features.rasterize(
    shapes,
    out_shape=raster.shape,
    transform=transform,
    fill=0,
    dtype=np.uint8
)

# 6. 输出二值数组
binary_array = rasterized.astype(int)
print("二值数组形状:", binary_array.shape)
print("非零像素数量:", np.sum(binary_array))


def rotate_clockwise(matrix):
    """顺时针旋转90度"""
    # 先转置，然后反转每一行
    transposed = list(zip(*matrix))
    rotated = [list(row)[::-1] for row in transposed]
    return rotated

binary_array = rotate_clockwise(binary_array)
binary_array = np.array(binary_array)





UTCI_14 = np.array(UTCI_14)
UTCI_15 = np.array(UTCI_15)
UTCI_16 = np.array(UTCI_16)


shape_number = int(SUM_SIZE/Grid_Size)


UTCI_14 = UTCI_14.reshape(shape_number,shape_number)
UTCI_15 = UTCI_15.reshape(shape_number,shape_number)
UTCI_16 = UTCI_16.reshape(shape_number,shape_number)



np.save(''+str(Path)+'x0'+str(epoch)+'/UTCI_14.npy', UTCI_14)
np.save(''+str(Path)+'x0'+str(epoch)+'/UTCI_15.npy', UTCI_15)
np.save(''+str(Path)+'x0'+str(epoch)+'/UTCI_16.npy', UTCI_16)


'''计算极值和平均值'''


UTCI_14_Data = UTCI_14
UTCI_14_Data[binary_array == 1] = 999
UTCI_14_Data = np.where(UTCI_14_Data > 500, np.nan, UTCI_14_Data)
UTCI_14_Data = np.where(UTCI_14_Data < BuildingTemperature, np.nan, UTCI_14_Data)

UTCI_15_Data = UTCI_15
UTCI_15_Data[binary_array == 1] = 999
UTCI_15_Data = np.where(UTCI_15_Data >  500, np.nan, UTCI_15_Data)
UTCI_15_Data = np.where(UTCI_15_Data < BuildingTemperature, np.nan, UTCI_15_Data)

UTCI_16_Data = UTCI_16
UTCI_16_Data[binary_array == 1] = 999
UTCI_16_Data = np.where(UTCI_16_Data > 500, np.nan, UTCI_16_Data)
UTCI_16_Data = np.where(UTCI_16_Data < BuildingTemperature, np.nan, UTCI_16_Data)



#计算极值


Max_UTCI_14_Data = np.nanmax(UTCI_14_Data)
Max_UTCI_15_Data = np.nanmax(UTCI_15_Data)
Max_UTCI_16_Data = np.nanmax(UTCI_16_Data)



Max_UTCI = (   Max_UTCI_14_Data + Max_UTCI_15_Data + Max_UTCI_16_Data )/3

#print(  Max_UTCI_14_Data, Max_UTCI_15_Data, Max_UTCI_16_Data, Max_UTCI)



#计算平均值


Mean_UTCI_14_Data = np.nanmean(UTCI_14_Data)
Mean_UTCI_15_Data = np.nanmean(UTCI_15_Data)
Mean_UTCI_16_Data = np.nanmean(UTCI_16_Data)


Mean_UTCI = ( Mean_UTCI_14_Data + Mean_UTCI_15_Data + Mean_UTCI_16_Data )/3

#print(  Mean_UTCI_14_Data, Mean_UTCI_15_Data, Mean_UTCI_16_Data, Mean_UTCI)



# #计算舒适率


UTCI_14_Data_filtered = UTCI_14
UTCI_14_Data_filtered[binary_array == 1] = 999
UTCI_14_Data_filtered[UTCI_14_Data_filtered < BuildingTemperature] = 999 #将大于0的不舒适区域转化为1
UTCI_14_Data_filtered = UTCI_14_Data_filtered[UTCI_14_Data_filtered != 999]


UTCI_15_Data_filtered = UTCI_15
UTCI_15_Data_filtered[binary_array == 1] = 999
UTCI_15_Data_filtered[UTCI_15_Data_filtered < BuildingTemperature] = 999 #将大于0的不舒适区域转化为1
UTCI_15_Data_filtered = UTCI_15_Data_filtered[UTCI_15_Data_filtered != 999]

UTCI_16_Data_filtered = UTCI_16
UTCI_16_Data_filtered[binary_array == 1] = 999
UTCI_16_Data_filtered[UTCI_16_Data_filtered < BuildingTemperature] = 999 #将大于0的不舒适区域转化为1
UTCI_16_Data_filtered = UTCI_16_Data_filtered[UTCI_16_Data_filtered != 999]






Deviation_UTCI_14 = UTCI_14_Data_filtered - Comfortable_UTCI 
Deviation_UTCI_15 = UTCI_15_Data_filtered - Comfortable_UTCI 
Deviation_UTCI_16 = UTCI_16_Data_filtered - Comfortable_UTCI 






# 14 时
Deviation_UTCI_14[Deviation_UTCI_14 > 0] = 99 #将大于0的不舒适区域转化为1
Deviation_UTCI_14[Deviation_UTCI_14 <= 0] = 1 #将小于零的区域转化为0
Deviation_UTCI_14[Deviation_UTCI_14 == 99] = 0 #将不舒适区域转化为0

comfortable_filtered_UTCI_14 = Deviation_UTCI_14[Deviation_UTCI_14 != 0] #删除不舒适区域
Heat_comfortable_Rate_14 = len(comfortable_filtered_UTCI_14) / int(len(UTCI_14_Data_filtered))
    

# 15 时
Deviation_UTCI_15[Deviation_UTCI_15 > 0] = 99 #将大于0的不舒适区域转化为1
Deviation_UTCI_15[Deviation_UTCI_15 <= 0] = 1 #将小于零的区域转化为0
Deviation_UTCI_15[Deviation_UTCI_15 == 99] = 0 #将不舒适区域转化为0

comfortable_filtered_UTCI_15 = Deviation_UTCI_15[Deviation_UTCI_15 != 0] #删除不舒适区域
Heat_comfortable_Rate_15 = len(comfortable_filtered_UTCI_15) / int(len(UTCI_15_Data_filtered))


# 16 时
Deviation_UTCI_16[Deviation_UTCI_16 > 0] = 99 #将大于0的不舒适区域转化为1
Deviation_UTCI_16[Deviation_UTCI_16 <= 0] = 1 #将小于零的区域转化为0
Deviation_UTCI_16[Deviation_UTCI_16 == 99] = 0 #将不舒适区域转化为0

comfortable_filtered_UTCI_16 = Deviation_UTCI_16[Deviation_UTCI_16 != 0] #删除不舒适区域
Heat_comfortable_Rate_16 = len(comfortable_filtered_UTCI_16) / int(len(UTCI_16_Data_filtered))






Heat_comfortable_Rate =   Heat_comfortable_Rate_14 + Heat_comfortable_Rate_15 + Heat_comfortable_Rate_16 
#print(Heat_comfortable_Rate_13, Heat_comfortable_Rate_14, Heat_comfortable_Rate_15, Heat_comfortable_Rate_16, Heat_comfortable_Rate_17, Heat_comfortable_Rate)



'''计算可接受率'''

Deviation_UTCI_14_Acceptable = UTCI_14_Data_filtered - Acceptable_UTCI 
Deviation_UTCI_15_Acceptable = UTCI_15_Data_filtered - Acceptable_UTCI 
Deviation_UTCI_16_Acceptable = UTCI_16_Data_filtered - Acceptable_UTCI 






# 14 时
Deviation_UTCI_14_Acceptable[Deviation_UTCI_14_Acceptable > 0] = 99 #将大于0的不舒适区域转化为1
Deviation_UTCI_14_Acceptable[Deviation_UTCI_14_Acceptable <= 0] = 1 #将小于零的区域转化为0
Deviation_UTCI_14_Acceptable[Deviation_UTCI_14_Acceptable == 99] = 0 #将不舒适区域转化为0

Acceptable_filtered_UTCI_14 = Deviation_UTCI_14_Acceptable[Deviation_UTCI_14_Acceptable != 0] #删除不舒适区域
Heat_Acceptable_Rate_14 = len(Acceptable_filtered_UTCI_14) / int(len(UTCI_14_Data_filtered))


# 15 时
Deviation_UTCI_15_Acceptable[Deviation_UTCI_15_Acceptable > 0] = 99 #将大于0的不舒适区域转化为1
Deviation_UTCI_15_Acceptable[Deviation_UTCI_15_Acceptable <= 0] = 1 #将小于零的区域转化为0
Deviation_UTCI_15_Acceptable[Deviation_UTCI_15_Acceptable == 99] = 0 #将不舒适区域转化为0

Acceptable_filtered_UTCI_15 = Deviation_UTCI_15_Acceptable[Deviation_UTCI_15_Acceptable != 0] #删除不舒适区域
Heat_Acceptable_Rate_15 = len(Acceptable_filtered_UTCI_15) / int(len(UTCI_15_Data_filtered))


# 16 时
Deviation_UTCI_16_Acceptable[Deviation_UTCI_16_Acceptable > 0] = 99 #将大于0的不舒适区域转化为1
Deviation_UTCI_16_Acceptable[Deviation_UTCI_16_Acceptable <= 0] = 1 #将小于零的区域转化为0
Deviation_UTCI_16_Acceptable[Deviation_UTCI_16_Acceptable == 99] = 0 #将不舒适区域转化为0

Acceptable_filtered_UTCI_16 = Deviation_UTCI_16_Acceptable[Deviation_UTCI_16_Acceptable != 0] #删除不舒适区域
Heat_Acceptable_Rate_16 = len(Acceptable_filtered_UTCI_16) / int(len(UTCI_16_Data_filtered))




Heat_Acceptable_Rate =  Heat_Acceptable_Rate_14 + Heat_Acceptable_Rate_15 + Heat_Acceptable_Rate_16 

#print( Heat_Acceptable_Rate_13, Heat_Acceptable_Rate_14, Heat_Acceptable_Rate_15, Heat_Acceptable_Rate_16, Heat_Acceptable_Rate_17, Heat_Acceptable_Rate)







'''最大舒适斑块统计'''




UTCI_14_Data_link = UTCI_14
UTCI_14_Data_link[binary_array == 1] = 999

UTCI_15_Data_link = UTCI_15
UTCI_15_Data_link[binary_array == 1] = 999

UTCI_16_Data_link = UTCI_16
UTCI_16_Data_link[binary_array == 1] = 999



UTCI_14_Data_link = UTCI_14_Data_link - Comfortable_UTCI 
UTCI_15_Data_link = UTCI_15_Data_link - Comfortable_UTCI 
UTCI_16_Data_link = UTCI_16_Data_link - Comfortable_UTCI





UTCI_14_Data_link[UTCI_14_Data_link > 0] = 99 #将大于0的不舒适区域转化为1
UTCI_14_Data_link[UTCI_14_Data_link <= 0] = 1 #将小于零的区域转化为0
UTCI_14_Data_link[UTCI_14_Data_link == 99] = 0 #将不舒适区域转化为0

UTCI_15_Data_link[UTCI_15_Data_link > 0] = 99 #将大于0的不舒适区域转化为1
UTCI_15_Data_link[UTCI_15_Data_link <= 0] = 1 #将小于零的区域转化为0
UTCI_15_Data_link[UTCI_15_Data_link == 99] = 0 #将不舒适区域转化为0

UTCI_16_Data_link[UTCI_16_Data_link > 0] = 99 #将大于0的不舒适区域转化为1
UTCI_16_Data_link[UTCI_16_Data_link <= 0] = 1 #将小于零的区域转化为0
UTCI_16_Data_link[UTCI_16_Data_link == 99] = 0 #将不舒适区域转化为0







# 1. 连通区域标记
labeled_array_14, num_features_14 = ndimage.label(UTCI_14_Data_link)

# 2. 计算每个舒适斑块的面积（像素数量）
areas_14 = ndimage.sum(
    input=(UTCI_14_Data_link == 1),  # 只统计值为1的区域
    labels=labeled_array_14,
    index=np.arange(1, num_features_14 + 1)  # 跳过背景标签0
)


labeled_array_15, num_features_15 = ndimage.label(UTCI_15_Data_link)

# 2. 计算每个舒适斑块的面积（像素数量）
areas_15 = ndimage.sum(
    input=(UTCI_15_Data_link == 1),  # 只统计值为1的区域
    labels=labeled_array_15,
    index=np.arange(1, num_features_15 + 1)  # 跳过背景标签0
)


labeled_array_16, num_features_16 = ndimage.label(UTCI_16_Data_link)

# 2. 计算每个舒适斑块的面积（像素数量）
areas_16 = ndimage.sum(
    input=(UTCI_16_Data_link == 1),  # 只统计值为1的区域
    labels=labeled_array_16,
    index=np.arange(1, num_features_16 + 1)  # 跳过背景标签0
)




try:
    Typical_Max_Comfort_Area_14 = max(areas_14) / int(len(UTCI_14_Data_filtered))
except:
    Typical_Max_Comfort_Area_14 = 0

try:
    Typical_Max_Comfort_Area_15 = max(areas_15) / int(len(UTCI_15_Data_filtered))
except:
    Typical_Max_Comfort_Area_15 = 0

try:
    Typical_Max_Comfort_Area_16 = max(areas_16) / int(len(UTCI_16_Data_filtered))
except:
    Typical_Max_Comfort_Area_16 = 0



Max_Comfort_Area =     Typical_Max_Comfort_Area_14 + Typical_Max_Comfort_Area_15 + Typical_Max_Comfort_Area_16 

Complete_information = True

#print(  Typical_Max_Comfort_Area_14, Typical_Max_Comfort_Area_15, Typical_Max_Comfort_Area_16, Max_Comfort_Area)

import gc
gc.collect()
# ---------- end gh_cpython_10 ----------
park_minimun_width = Panel("12")
# 创建负值的体块，消除高度为负的建筑
# 创建一个与网格大小一致的rectangle
panel_33 = Panel(gh_cpython_10.Max_Comfort_Area)
panel_34 = Panel(gh_cpython_10.Heat_Acceptable_Rate)
panel_35 = Panel(gh_cpython_10.Heat_comfortable_Rate)
panel_36 = Panel(gh_cpython_10.Mean_UTCI)
panel_37 = Panel(gh_cpython_10.Max_UTCI)
calculation_of_event_venue_size = GH_CPython(
    Run_if=image_crop_for_greenarea.Complete_information,
    BuildSample_img_Path=pc_gan_model_for_building.save_Path,
    GreenSample_img_Path=pc_gan_for_greenarea.green_save_Path,
    Minimum_width=park_minimun_width)  # -> Sum_Event_Area_Rate, Max_Event_Area_Rate, Event_Area_Rate; inputs Run_if: list, BuildSample_img_Path: list, GreenSample_img_Path: list, Minimum_width: list
#   port Run_if: [required] - [type = int] - [default = None] Descripe your input here * bullet point. * bullet point
#   port Event_Area_Rate: indicate your output description here. refers to a new line.
# ---------- calculation_of_event_venue_size: Python ----------
# -*- coding: utf-8 -*-

import pandas as pd
import numpy as np
import gc
import matplotlib.pyplot as plt
from PIL import Image
import cv2

from scipy import ndimage


if Run_if==True:

    # 读取图像并确保RGB顺序（OpenCV默认BGR）
    img = Image.open(BuildSample_img_Path).convert("RGB")  # shape (250, 250, 3)
    img_array = np.array(img)  # shape=(250,250,3)
    # 提取 RGB 通道
    R = img_array[:, :, 0]
    G = img_array[:, :, 1]
    B = img_array[:, :, 2]

    # 生成二值掩膜矩阵（满足 R=245 且 B=1 的像素为 1，其余为 0）
    binary_mask = np.where((R == 245) & (B == 1), 1, 0).astype(np.uint8)

    print(binary_mask.shape)


    # 连通域分析
    num_labels, labels, stats, centroids = cv2.connectedComponentsWithStats(
        binary_mask, connectivity=8
    )

    Ex_building_edges = 5
    expanded_mask = np.zeros_like(binary_mask)

    # 处理每个斑块（跳过背景标签0）
    for label in range(1, num_labels):
        # 提取当前斑块掩膜
        blob_mask = (labels == label).astype(np.uint8) * 255
        
        # 提取边缘（Canny算法）
        edges = cv2.Canny(blob_mask, 100, 200)
        
        # 外扩5像素：使用5x5圆形结构核进行膨胀
        kernel = cv2.getStructuringElement(cv2.MORPH_ELLIPSE, (Ex_building_edges, Ex_building_edges))
        expanded_edges = cv2.dilate(edges, kernel, iterations=1)
        
        # 合并原始斑块与外扩边缘
        expanded_blob = cv2.bitwise_or(blob_mask, expanded_edges)
        expanded_mask = cv2.bitwise_or(expanded_mask, expanded_blob)


    print(expanded_mask.shape)
    expanded_mask = np.array(expanded_mask).astype(np.int64)
    print(max(expanded_mask.flatten()))





    # 读取图像并确保RGB顺序（OpenCV默认BGR）
    img = Image.open(GreenSample_img_Path).convert("RGB")  # shape (250, 250, 3)
    img_array = np.array(img)  # shape=(250,250,3)

    # 定义目标RGB值
    target_color1 = (170, 255, 10)  # 绿色系
    target_color2 = (15, 15, 15)    # 深灰色

    # 创建二值掩膜（250x250）
    mask = np.zeros((256, 256), dtype=np.uint8)

    # 遍历每个像素进行颜色匹配
    for y in range(256):
        for x in range(256):
            r, g, b = img_array[y, x]
            # 检查是否匹配任一目标颜色
            if (r, g, b) == target_color1 or (r, g, b) == target_color2:
                mask[y, x] = 1  # 匹配则标记为1

    mask = mask.astype(np.uint8)

    mask = np.array(mask)



    '''删除建筑边缘禁建区域数值'''
    # 创建掩码：标记B中值为1的位置
    Building_mask = (expanded_mask == 255)
    mask[Building_mask] = 0




    '''识别口袋公园的可建区域'''
    '''删除像素，以匹配12分辨率计算'''

    # 步骤1：删除下方4行（最后4行）
    mask = mask[:-4]
    # 步骤2：删除每行的左边4列（前4个元素）
    mask = [row[4:] for row in mask]  # 每行保留6-255列
    mask = np.array(mask)
    #print(mask.shape)



    Sum_Size = 256
    grid_number = ((Minimum_width/2)*(Minimum_width/2))
    block_counts_threshold = grid_number * 0.8

    '''转换为12m分辨率的网格'''
    reshaped = mask.reshape(int(Sum_Size/(Minimum_width/2)), int(Minimum_width/2), int(Sum_Size/(Minimum_width/2)), int(Minimum_width/2))

    # 沿第1和第3维度求和（每个5x5块的总和）
    block_counts = reshaped.sum(axis=(1, 3))  # shape=(50,50)
    # 判断是否过80%
    downsampled_img = np.where(block_counts >= block_counts_threshold, 1, 0)

    '''删除左和下方一行'''
    downsampled_img = downsampled_img[:-1]
    downsampled_img = [row[1:] for row in downsampled_img]  # 每行保留6-255列
    downsampled_img = np.array(downsampled_img)

    #print(downsampled_img.shape)


    '''数量统计'''
    # 1. 连通区域标记
    labeled_array, num_features = ndimage.label(downsampled_img)

    # 2. 计算每个斑块的面积（像素数量）
    areas = ndimage.sum(
        input=(downsampled_img == 1),  # 只统计值为1的区域
        labels=labeled_array,
        index=np.arange(1, num_features + 1)  # 跳过背景标签0
    )


    areas = areas*(Minimum_width/2)*(Minimum_width/2)

    filtered_Area = [x for x in areas if x > 400]
    #print(filtered_Area)


    Sum_Event_Area = sum(filtered_Area)
    Max_Event_Area = max(filtered_Area)


    Sum_Event_Area_Rate = Sum_Event_Area/(500*500)
    Max_Event_Area_Rate = Max_Event_Area/(500*500)

    #print(Sum_Event_Area_Rate, Max_Event_Area_Rate)


    Event_Area_Rate = Sum_Event_Area_Rate + Max_Event_Area_Rate


    del img_array, R, G, B, binary_mask, expanded_mask, mask, reshaped, block_counts, labeled_array
    gc.collect()  # 强制垃圾回收
# ---------- end calculation_of_event_venue_size ----------

# ---- group: Sunshine_compliance_Rate
the_minimum_acceptable_duration_of_sunli = Panel("5")  # "The minimum acceptable duration of sunlight"
pixel_error_tolerance = Panel("28")
sunshine_compliance_rate = Sunshine_compliance_Rate(
    Run_if=image_crop.Complete_information,
    error=pixel_error_tolerance,
    Building_img_path=image_crop.save_Path,
    Define_Hour_number=the_minimum_acceptable_duration_of_sunli)  # -> Sunshine_compliance_Rate; inputs Run_if: list, error: list, Building_img_path: list, Define_Hour_number: list
#   port error: [required] - [type = int] - [default = None] Descripe your input here * bullet point. * bullet point
#   port Sunshine_compliance_Rate: indicate your output description here. refers to a new line.
# ---------- sunshine_compliance_rate: Python ----------
# -*- coding: utf-8 -*-

import numpy as np
import pandas as pd
import matplotlib.pyplot as plt
import pytz
from PIL import Image
from pvlib import solarposition
from matplotlib.colors import LinearSegmentedColormap
import math
import datetime
from pysolar.solar import get_altitude, get_azimuth
import datetime

import numpy as np
from pysolar.solar import get_altitude, get_azimuth
import pytz
from datetime import datetime, timedelta

import numpy as np
# import tifffile
from io import BytesIO

import rasterio
import numpy as np
from rasterio.transform import Affine
from pvlib.solarposition import get_solarposition
from skimage.measure import label
from scipy import ndimage
import pandas as pd
import numpy as np
from io import BytesIO

error = error

if Run_if == True:

    Image = Image.open(Building_img_path) #打开Pix2pixA predict的图像Pix2A Ture
    # 转换为RGB模式
    Image = Image.convert("RGB")
    # 获取像素点数据
    pixel = Image.load()


    width, height = Image.size #获取图片的尺寸

    '''Pix2PixB数据包装'''
    data_PixB = []

    for x in range(width):
        for y in range(height):
            r, g, b = pixel[x, y]

            #识别建筑，转化为建筑高度波段
            if (245-error)<= r <=(245+error)  and  b<=(1+error):
                data_PixB.append(g)
            else:
                data_PixB.append(0)


    data_PixB = np.array(data_PixB)
    data_PixB = data_PixB.reshape(250,250)

    print(data_PixB.shape)

    data_PixB = data_PixB.astype(np.float32)




    # 定义地理信息参数（示例：深圳某区域，分辨率2米）
    transform = Affine(2.0, 0.0, 114.0, 0.0, -2.0, 22.5)  # 左上角坐标(114,22.5)，Y向下
    crs = "EPSG:4326"  # WGS84坐标系

    # 将数组写入内存中的TIFF流
    with BytesIO() as buffer:
        # 使用rasterio写入内存流
        with rasterio.open(
            buffer,
            "w",
            driver="GTiff",
            dtype=data_PixB.dtype,
            count=1,
            width=data_PixB.shape[1],
            height=data_PixB.shape[0],
            transform=transform,
            crs=crs
        ) as dst:
            dst.write(data_PixB, 1)  # 写入第一个波段
        
        # 从内存流中读取数据
        buffer.seek(0)  # 重置指针位置
        with rasterio.open(buffer) as src:
            height_array  = src.read(1)
        mask = (height_array > 0).astype(np.uint8)  # 0为非建筑区域，1为建筑区域

        # 执行连通域分析（根据深圳建筑规范设置8邻域连接）
        labeled_array, num_buildings = label(
            mask, 
            connectivity=2,  # 2表示8邻域连接（网页1规范要求）
            return_num=True  # 必须显式启用返回特征数
    )
        




    # 1. 参数设置
    latitude = 22 + 40/60  # 深圳纬度北纬22°40'[1](@ref)
    longitude = 113 + 41/60  # 深圳经度东经113°41'[1](@ref)
    date = datetime(2025, 12, 22)  # 2025年冬至日
    timezone = pytz.timezone('Asia/Shanghai')
    resolution = 2  # 空间分辨率2米/像素

    # 2. 太阳位置计算
    times = pd.date_range(
        start=datetime(date.year, date.month, date.day, 8, 0),  # 8:00开始[1](@ref)
        end=datetime(date.year, date.month, date.day, 16, 0),   # 16:00结束[1](@ref)
        freq='5T',  # 5分钟间隔[1](@ref)
        tz=timezone
    )
    solar_pos = solarposition.get_solarposition(times, latitude, longitude)

    # 3. 建筑南立面提取
    from skimage.measure import regionprops  # 新增导入

    def extract_south_facade(labeled_array, height_array):
        """提取建筑南立面坐标及对应高度"""
        south_points = []
        for region in regionprops(labeled_array):  # 现在已定义
            y_min, x_min, y_max, x_max = region.bbox  # 通过bbox属性获取边界框坐标[3](@ref)
            south_edge = y_max - 1  # 建筑南侧边界(Y轴向下)
            for x in range(x_min, x_max):
                if height_array[south_edge, x] > 0:
                    elevation = height_array[south_edge, x] + 0.9  # 基准面高度计算
                    south_points.append((x, south_edge, elevation))
        return np.array(south_points)

    south_points = extract_south_facade(labeled_array, height_array)



    '''超精细的阴影计算'''
    def is_sunny(x, y, elevation, sun_alt, sun_az):
        """多角度阴影投射算法（支持半影计算）"""
        if sun_alt <= 0:
            return False

        # 参数配置（依据深圳规范优化）
        sun_radius = 0.533  # 太阳视半径0.533度[1](@ref)
        num_rays = 2        # 采样射线数量[2](@ref)
        base_step = 2.0     # 基础步长(米)
        max_dist = 1000     # 最大检测距离
        
        # 生成泊松圆盘采样点[2](@ref)
        angles = np.linspace(0, 2*np.pi, num_rays, endpoint=False)
        offsets = np.array([(np.cos(a)*sun_radius, np.sin(a)*sun_radius) 
                          for a in angles])

        visible_count = 0
        
        for dx_ang, dy_ang in offsets:
            # 修正太阳方位角与高度角
            mod_az = sun_az + dx_ang * np.cos(np.radians(sun_alt))
            mod_alt = sun_alt + dy_ang * np.sin(np.radians(sun_alt))
            
            # 射线方向向量（地理坐标系转换）
            step_x = base_step * np.sin(np.radians(mod_az))
            step_y = base_step * np.cos(np.radians(mod_az))
            
            # 自适应步进参数
            current_pos = np.array([x, y], dtype=np.float32)
            total_dist = 0.0
            is_occluded = False
            
            while total_dist < max_dist and not is_occluded:
                # 动态步长调整（近场加密）
                dynamic_step = base_step * (1 + total_dist/500)  # 距离越远步长越大[3](@ref)
                
                current_pos += np.array([step_x, -step_y]) * dynamic_step  # Y轴向下
                total_dist += dynamic_step
                
                # 边界检测
                if (current_pos[0] < 0 or current_pos[0] >= height_array.shape[1] or 
                    current_pos[1] < 0 or current_pos[1] >= height_array.shape[0]):
                    break
                    
                # 双线性插值地形高度[3](@ref)
                x_floor, y_floor = int(np.floor(current_pos[0])), int(np.floor(current_pos[1]))
                x_frac, y_frac = current_pos[0] - x_floor, current_pos[1] - y_floor
                
                h00 = height_array[y_floor, x_floor]
                h01 = height_array[y_floor, min(x_floor+1, height_array.shape[1]-1)]
                h10 = height_array[min(y_floor+1, height_array.shape[0]-1), x_floor]
                h11 = height_array[min(y_floor+1, height_array.shape[0]-1), 
                                 min(x_floor+1, height_array.shape[1]-1)]
                
                terrain_height = (h00*(1-x_frac)*(1-y_frac) + h01*x_frac*(1-y_frac) +
                                h10*(1-x_frac)*y_frac + h11*x_frac*y_frac)
                
                # 阴影高度计算（含曲率修正）
                shadow_height = elevation + total_dist * np.tan(np.radians(mod_alt))
                
                if terrain_height > shadow_height + 0.5:  # 增加0.5米安全裕度[1](@ref)
                    is_occluded = True
                    break
                    
            if not is_occluded:
                visible_count += 1
                
        # 可见性判定（20%阈值对应半影效应）
        return (visible_count / num_rays) > 0.2

    # 5. 日照时间累计
    sunlight_hours = np.zeros(len(south_points))
    for idx, (time, pos) in enumerate(solar_pos.iterrows()):
        sun_alt = pos['elevation']
        sun_az = pos['azimuth']
        
        for i, (x, y, h) in enumerate(south_points):
            if is_sunny(x, y, h, sun_alt, sun_az):
                sunlight_hours[i] += 5/60  # 每个间隔5分钟

    # 6. 结果判定
    Sunshine_compliance_Rate = (sunlight_hours >= Define_Hour_number).sum() / len(sunlight_hours)  # 符合率[6](@ref)

    
    del height_array, labeled_array, solar_pos, south_points
    import gc
    gc.collect()  # 强制垃圾回收[6](@ref)
# ---------- end sunshine_compliance_rate ----------

# ----
mean_utci = GH_CPython(A=gh_cpython_10.Mean_UTCI)  # -> Result; inputs A: list
#   port A: [required] - [type = int] - [default = None] Descripe your input here * bullet point. * bullet point
#   port Result: indicate your output description here. refers to a new line.
# ---------- mean_utci: Python ----------
# -*- coding: utf-8 -*-
Result = A
Result = round(Result, 2)

import gc
gc.collect()
# ---------- end mean_utci ----------
max_utci = GH_CPython(A=gh_cpython_10.Max_UTCI)  # -> Result; inputs A: list; same code as mean_utci
sum_comfortable_area = GH_CPython(A=gh_cpython_10.Heat_comfortable_Rate)  # -> Result; inputs A: list
#   port A: [required] - [type = int] - [default = None] Descripe your input here * bullet point. * bullet point
#   port Result: indicate your output description here. refers to a new line.
# ---------- sum_comfortable_area: Python ----------
# -*- coding: utf-8 -*-
Result = A 


Result = 1- (Result/3)
Result = round(Result, 2)

import gc
gc.collect()
# ---------- end sum_comfortable_area ----------
max_comfortable_area = GH_CPython(A=gh_cpython_10.Max_Comfort_Area)  # -> Result; inputs A: list; disabled; same code as sum_comfortable_area
sum_accept_area = GH_CPython(A=gh_cpython_10.Heat_Acceptable_Rate)  # -> Result; inputs A: list; same code as sum_comfortable_area
event_area = GH_CPython(A=calculation_of_event_venue_size.Sum_Event_Area_Rate)  # -> Result; inputs A: list
#   port A: [required] - [type = int] - [default = None] Descripe your input here * bullet point. * bullet point
#   port Result: indicate your output description here. refers to a new line.
# ---------- event_area: Python ----------
# -*- coding: utf-8 -*-
Result = 1 - A
print(Result)
Result = round(Result, 2)

import gc
gc.collect()
# ---------- end event_area ----------
far = GH_CPython(A=gh_cpython_8.FAR)  # -> Result; inputs A: list
#   port A: [required] - [type = int] - [default = None] Descripe your input here * bullet point. * bullet point
#   port Result: indicate your output description here. refers to a new line.
# ---------- far: Python ----------
# -*- coding: utf-8 -*-
Result = 1 / A
print(Result)
Result = round(Result, 2)

import gc
gc.collect()
# ---------- end far ----------
sunshine_compliance_rate_2 = GH_CPython(Rate="0.85", A=sunshine_compliance_rate)  # -> Result; inputs Rate: list, A: list
#   port A: [required] - [type = int] - [default = None] Descripe your input here * bullet point. * bullet point
#   port Result: indicate your output description here. refers to a new line.
# ---------- sunshine_compliance_rate_2: Python ----------
# -*- coding: utf-8 -*-
Result = Rate - A

Result = max(Result,0)
Result = round(Result, 2)

import gc
gc.collect()
# ---------- end sunshine_compliance_rate_2 ----------

# ---- group: Positive standard: MAX_for_FAR = 1 / FAR
far_2 = Number(flatten(far))

# ----
max_comfort_area_rate = Number(flatten(max_comfortable_area))  # disabled
sum_comfortable_rate = Number(flatten(sum_comfortable_area))
sum_accept_area_2 = Number(flatten(sum_accept_area))

# ---- group: Negative criterion: Glodal_UTCI
mean_godal_utci = Number(flatten(mean_utci))

max_utci_2 = Number(flatten(max_utci))

# ---- group: Positive standard: MAX_Event_Area_Rate = (1/Event_Area_Rate)-1
unevent_area_rate = Number(flatten(event_area))

# ---- group: Positive standard: MAX_Sunshine_compliance_Rate = (1/Sunshine_compliance_Rate)-1
sunshine_compliance_rate_3 = Number(flatten(sunshine_compliance_rate_2))

# ----
wallacei_x = WallaceiX(
    Genes=[wlc_1, wlc_2, wlc_3, wlc_4],
    Objectives=[sum_comfortable_rate, mean_godal_utci, max_utci_2, unevent_area_rate, far_2, sunshine_compliance_rate_3, sum_accept_area_2],
    allFitness="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",
    allFrontIdx="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",
    allGenomes="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",
    curFrontIdx="59|0;59|1;59|2;59|3;59|4;59|5;59|6;59|7;59|8;59|9;59|10;59|11;59|12;59|13;59|14;59|15;59|16;59|17;59|18;59|19;59|20;59|21;59|22;59|23;59|24;59|25;59|26;59|27;59|28;59|29;59|30;59|31;59|32;59|33;59|34;59|35;59|36;59|37;59|38;59|39;59|40;59|41;59|42;59|43;59|44;59|45;59|46;59|47;59|48;59|49",
    curFrontIdxSave="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",
    popGen="50,60",
    total="-1344154139",
    wlcDone=True)  # -> WallaceiGenomes, FitnessValues, Data, Phenotypes
gh_cpython_11 = GH_CPython(
    Run_if=gh_cpython_10.Complete_information,
    Epoch=image_crop.epoch_output,
    Sunshine_compliance_Rate=sunshine_compliance_rate,
    FAR=gh_cpython_8.FAR,
    UnEvent_Area_Rate=calculation_of_event_venue_size.Sum_Event_Area_Rate,
    Max_UTCI=max_utci_2,
    Mean_Godal_UTCI=mean_godal_utci,
    Sum_comfortable_Rate=gh_cpython_10.Heat_comfortable_Rate,
    Max_Comfort_Area_Rate=gh_cpython_10.Max_Comfort_Area,
    Sum_Accept_Area=gh_cpython_10.Heat_Acceptable_Rate,
    Scheme_Save_Path=working_spaces)  # -> output; inputs Run_if: list, Epoch: list, Sunshine_compliance_Rate: list, FAR: list, UnEvent_Area_Rate: list, Max_UTCI: list, Mean_Godal_UTCI: list, Sum_comfortable_Rate: list, Max_Comfort_Area_Rate: list, Sum_Accept_Area: list, Scheme_Save_Path: list
#   port Epoch: [required] - [type = int] - [default = None] Descripe your input here * bullet point. * bullet point
#   port output: indicate your output description here. refers to a new line.
# ---------- gh_cpython_11: Python ----------
import pandas as pd
import numpy as np


if Run_if == True:

    data_record = []


    data_record.append([Epoch, Sunshine_compliance_Rate, FAR, UnEvent_Area_Rate, Max_UTCI, Mean_Godal_UTCI, Sum_comfortable_Rate,Max_Comfort_Area_Rate, Sum_Accept_Area])

    data_record = pd.DataFrame(data_record)
    data_record.columns = ['Epoch', 'Sunshine_compliance_Rate', 'FAR', 'UnEvent_Area_Rate', 'Max_UTCI', 'Mean_Godal_UTCI', 'Sum_comfortable_Rate', 'Max_Comfort_Area_Rate','Sum_Accept_Area']

    print(data_record)

    data_record.to_csv(''+str(Scheme_Save_Path)+'x0'+str(Epoch)+'/Object_Record.csv',header=True)


    output_ = True
# ---------- end gh_cpython_11 ----------
gh_cpython_12 = GH_CPython(Run_if=gh_cpython_11, value_a=epoch_read.value_v, Epoch_Reference_Path=panel)  # -> value_new_output, Complete_information_output; inputs Run_if: list, value_a: list, Epoch_Reference_Path: list
#   port Run_if: [required] - [type = int] - [default = None] Descripe your input here * bullet point. * bullet point
#   port Complete_information_output: indicate your output description here. refers to a new line.
# ---------- gh_cpython_12: Python ----------
# -*- coding: utf-8 -*-
import pandas as pd
import numpy as np


if Run_if == True :

    value_new = value_a + 1

    value_new_output = value_new
    value_new = np.array([[value_new]])
    value_new = pd.DataFrame(value_new)

    value_new.columns = ['value']
    value_new.to_csv(Epoch_Reference_Path,header=True,index=False)

    Complete_information_output = True
# ---------- end gh_cpython_12 ----------
panel_38 = Panel(gh_cpython_12.Complete_information_output)  # disabled
